# Dynamo custom node WriteOrAppendExcel_v2.dyf (Dynamo 2.0.2.6826)
# category: ZebraGoldFish
# Writes or Appends data to excel sheet

boolean = BoolSelector(true)
sheetName = Input(sheetName: string = null)
code_block = CodeBlock { "A"; 1; "A1"; }
filepath = Input(filepath: var = null)
fileExists = FileSystem.FileExists(path=filepath)
boolean_2 = BoolSelector(true)
read_excel = Custom[Read Excel](filePath=filepath, runIt=fileExists, sheetName=sheetName, byColumn=boolean_2)  # This node will read an excel file. You can read an entore sheet contents, read from specific origin cell, read only specific range, or do all of the former for multiple sheets at the same time.
code_block_2 = CodeBlock { 0; }
getItemAtIndex = List.GetItemAtIndex(list=read_excel, index=code_block_2)
flatten = List.Flatten(list=getItemAtIndex)
count = List.Count(list=flatten)
add = code_block.out1 + count
string_from_object = FromObject(obj=add)
concat = String.Concat(string0=code_block.out0, string1=string_from_object)
newData = Input(newData: var[]..[])
bb_data = Custom[BB Data](sheetName=sheetName, origin=concat, data=newData)  # This node is a building block for different modes of writing to Excel files. You can combines this node into a list to write to multiple sheets or use just one to write to a single sheet.
baseData = Input(baseData: var[]..[])
bb_data_2 = Custom[BB Data](sheetName=sheetName, origin=code_block.out2, data=baseData)
join = List.Join(list0=bb_data, list1=bb_data_2)
not_ = Not(x=fileExists)
flatten_2 = List.Flatten(list=read_excel)
string_from_object_2 = FromObject(obj=flatten_2)
python_script = Python(IN[0]=string_from_object_2)
# ---------- python_script.python (15 lines) ----------
# Enable Python support and load DesignScript library
import clr
clr.AddReference('ProtoGeometry')
from Autodesk.DesignScript.Geometry import *

# The inputs to this node will be stored as a list in the IN variables.
dataEnteringNode = IN

# Place your code below this line
outString = ""
inL = IN[0]
for text in inL:
	outString += text
# Assign your output to the OUT variable.
OUT = outString
# ----------------------------------------
code_block_3 = CodeBlock { "Traceback"; }
boolean_3 = BoolSelector(true)
contains = String.Contains(str=python_script, searchFor=code_block_3, ignoreCase=boolean_3)
and_ = fileExists && contains
or_ = not_ || and_
python_script_2 = Python(IN[0]=join, IN[1]=or_, IN[2]=fileExists)
# ---------- python_script_2.python (18 lines) ----------
# Enable Python support and load DesignScript library
import clr
clr.AddReference('ProtoGeometry')
from Autodesk.DesignScript.Geometry import *

# The inputs to this node will be stored as a list in the IN variables.
dataEnteringNode = IN
dataL = IN[0]
bool1 = IN[1]
bool2 = IN[2]
# Place your code below this line
if bool1:
	OUT = dataL[1]
elif bool2:
	OUT = dataL[0]
else:
	OUT = null
# Assign your output to the OUT variable.
# ----------------------------------------
OUT = Output(python_script_2)
