# Dynamo graph PHD Criteria 1.dyn (Dynamo 2.0.2.6826)

# group: Legends
code_block = CodeBlock { "1:"; "Scale Value    1:"; }
boolean = BoolSelector(true)
python_legend_collector = Python(IN[0]=boolean)
# ---------- python_legend_collector.python (36 lines) ----------
#Copyright(c) 2017, john pierson
# @60secondrevit, http://sixtysecondrevit.com

import clr
clr.AddReference('ProtoGeometry')
from Autodesk.DesignScript.Geometry import *

# Import DocumentManager and TransactionManager
clr.AddReference("RevitServices")
import RevitServices
from RevitServices.Persistence import DocumentManager
from RevitServices.Transactions import TransactionManager

# Import RevitAPI
clr.AddReference("RevitAPI")
import Autodesk
from Autodesk.Revit.DB import *

doc = DocumentManager.Instance.CurrentDBDocument
uiapp = DocumentManager.Instance.CurrentUIApplication
app = uiapp.Application

from System.Collections.Generic import *


#The inputs to this node will be stored as a list in the IN variable.
dataEnteringNode = IN
collector = FilteredElementCollector(doc)
sheets = collector.OfCategory(BuiltInCategory.OST_Views).ToElements()

sheetInstances = []
for i in sheets:
	if i.ViewType.ToString() == "Legend":
		sheetInstances.append(i)

OUT = sheetInstances
# ----------------------------------------
getParameterValueByName = Element.GetParameterValueByName(element=python_legend_collector, parameterName=code_block.out1)
add = code_block.out0 + getParameterValueByName
name = Element.Name(element=python_legend_collector)
legend_names = Watch(name)
legend_scale = Watch(getParameterValueByName)

# group: Links
empty = List.Empty()
python_script = Python(IN[0]=empty)
# ---------- python_script.python (50 lines) ----------
#Copyright(c) 2015, Konrad K Sobon
# @arch_laboratory, http://archi-lab.net

# Huge thanks to Andreas Dieckmann for 
# adding link path functionality

import clr
clr.AddReference('ProtoGeometry')
from Autodesk.DesignScript.Geometry import *

# Import DocumentManager and TransactionManager
clr.AddReference("RevitServices")
import RevitServices
from RevitServices.Persistence import DocumentManager
from RevitServices.Transactions import TransactionManager

from System.Collections.Generic import *

# Import RevitAPI
clr.AddReference("RevitAPI")
import Autodesk
from Autodesk.Revit.DB import *
from Autodesk.Revit.DB.Analysis import *

doc = DocumentManager.Instance.CurrentDBDocument
uiapp = DocumentManager.Instance.CurrentUIApplication
app = uiapp.Application

# Import ToDSType(bool) extension method
clr.AddReference("RevitNodes")
import Revit
clr.ImportExtensions(Revit.Elements)

#The inputs to this node will be stored as a list in the IN variable.
dataEnteringNode = IN

collector = Autodesk.Revit.DB.FilteredElementCollector(doc)
linkInstances = collector.OfClass(Autodesk.Revit.DB.RevitLinkInstance)

linkDoc, linkName, linkPath = [], [], []
for i in linkInstances:
	linkDoc.append(i.GetLinkDocument())
	linkName.append(i.Name)
	try:
		linkPath.append(i.GetLinkDocument().PathName)
	except:
		linkPath.append(None)
		pass

OUT = linkDoc, linkName, linkInstances, linkPath
# ----------------------------------------
code_block_2 = CodeBlock(seq=python_script) { seq[0]; seq[3]; }
projectPosition = Custom[Document.ProjectPosition](docOrRevitLinkInstance=code_block_2.out0)  # Gets the project's position data relative to the origin. Output coordinates may diverge from the project base point coordinates once the project base point has been moved in an unclipped state. Use the built-in nodes Location.Latitude & Location.Longitude to retrieve latitude and longitude.
list_create = List.Create(item0=projectPosition.Angle_degr, item1=projectPosition.Elevation, item2=projectPosition.EastWest, item3=projectPosition.NorthSouth)
transpose = List.Transpose(lists=list_create)
position_data = Watch(transpose)
categories = Categories(index=430)
all_elements_of_category = ElementsOfCategory(Category=categories)
name_2 = Element.Name(element=all_elements_of_category)
code_block_3 = CodeBlock { ": "; }
split = String.Split(str=name_2, separater0=code_block_3)
code_block_4 = CodeBlock { 0; 1; 2; }
getItemAtIndex = List.GetItemAtIndex(list=split@L2, index=code_block_4.out0)
file_name = Watch(getItemAtIndex)
getItemAtIndex_2 = List.GetItemAtIndex(list=split@L2, index=code_block_4.out1)
link_name = Watch(getItemAtIndex_2)
getItemAtIndex_3 = List.GetItemAtIndex(list=split@L2, index=code_block_4.out2)
location_type = Watch(getItemAtIndex_3)
link_path = Watch(code_block_2.out1)

# group: Worksets
categories_2 = Categories(index=602)
all_elements_of_category_2 = ElementsOfCategory(Category=categories_2)
getAll = archilab.Revit.Elements.Workset.GetAll()
id = archilab.Revit.Elements.Workset.Id(workset=getAll)
list_create_2 = List.Create()  # unwired: item0
map = List.Map(list=id, f_x=list_create_2)
getWorksetVisibility = Rhythm.Revit.Views.View.GetWorksetVisibility(view=all_elements_of_category_2, worksetId=map@L2)
flatten = List.Flatten(list=getWorksetVisibility@L3)
visable_in_view = Watch(flatten)
name_3 = archilab.Revit.Elements.Workset.Name(workset=getAll)
workset_name = Watch(name_3)

file_path = Filename("Excel Output\Test Output Current.xlsx")  # graph input; frozen
string = StringInput("Placed Views")  # graph input
code_block_5 = CodeBlock { 0; }
code_block_6 = CodeBlock { "View Names"; }

# group: placed Views
code_block_7 = CodeBlock { " "; }
categories_3 = Categories(index=602)
all_elements_of_category_3 = ElementsOfCategory(Category=categories_3)
code_block_8 = CodeBlock { ""; }
code_block_9 = CodeBlock { "Referencing Sheet"; }
getParameterValueByName_2 = Element.GetParameterValueByName(element=all_elements_of_category_3, parameterName=code_block_9)
eq = code_block_8 == getParameterValueByName_2
filterByBoolMask = List.FilterByBoolMask(list=all_elements_of_category_3, mask=eq)
type = archilab.Revit.Elements.Elements.Type(element=filterByBoolMask.out)
name_4 = FamilyType.Name(familyType=type)
isNull = Object.IsNull(obj=name_4)
filterByBoolMask_2 = List.FilterByBoolMask(list=filterByBoolMask.out, mask=isNull)
filterByBoolMask_3 = List.FilterByBoolMask(list=name_4, mask=isNull)
groupByKey = List.GroupByKey(list=filterByBoolMask_2.out, keys=filterByBoolMask_3.out)
name_5 = Element.Name(element=groupByKey.groups)
addItemToEnd = List.AddItemToEnd(item=code_block_7, list=name_5@L2)
flatten_2 = List.Flatten(list=addItemToEnd)
view_names = Watch(flatten_2)
code_block_10 = CodeBlock { " "; }
code_block_11 = CodeBlock { "1:"; "Scale Value    1:"; }
getParameterValueByName_3 = Element.GetParameterValueByName(element=groupByKey.groups, parameterName=code_block_11.out1)
addItemToEnd_2 = List.AddItemToEnd(item=code_block_10, list=getParameterValueByName_3@L2)
flatten_3 = List.Flatten(list=addItemToEnd_2)
view_scale = Watch(flatten_3)
groupByKey_2 = List.GroupByKey(list=filterByBoolMask_3.out, keys=filterByBoolMask_3.out)
addItemToEnd_3 = List.AddItemToEnd(item=code_block_10, list=groupByKey_2.groups@L2)
flatten_4 = List.Flatten(list=addItemToEnd_3)
type_2 = Watch(flatten_4)
getParameterValueByName_4 = Element.GetParameterValueByName(element=groupByKey.groups, parameterName=code_block_9)
addItemToEnd_4 = List.AddItemToEnd(item=code_block_10, list=getParameterValueByName_4@L2)
flatten_5 = List.Flatten(list=addItemToEnd_4)
sheet = Watch(flatten_5)

addItemToFront = List.AddItemToFront(item=code_block_6, list=view_names)
code_block_12 = CodeBlock { "View Scale"; }
addItemToFront_2 = List.AddItemToFront(item=code_block_12, list=view_scale)
code_block_13 = CodeBlock { "Type"; }
addItemToFront_3 = List.AddItemToFront(item=code_block_13, list=type_2)
code_block_14 = CodeBlock { "Sheet"; }
addItemToFront_4 = List.AddItemToFront(item=code_block_14, list=sheet)
code_block_15 = CodeBlock { "View Template"; }
viewTemplate = archilab.Revit.Views.Views.ViewTemplate(view=groupByKey.groups)
name_6 = Element.Name(element=viewTemplate)
replaceNulls = Lists.Manage.ReplaceNulls(Data=name_6, ReplaceWith=code_block_10)
addItemToEnd_5 = List.AddItemToEnd(item=code_block_10, list=replaceNulls@L2)
flatten_6 = List.Flatten(list=addItemToEnd_5)
sheet_2 = Watch(flatten_6)
addItemToFront_5 = List.AddItemToFront(item=code_block_15, list=sheet_2)
code_block_16 = CodeBlock { "Creator"; }
python_script_2 = Python(IN[0]=filterByBoolMask_2.out)
# ---------- python_script_2.python (27 lines) ----------
import clr
clr.AddReference('RevitServices')
import RevitServices
from RevitServices.Persistence import DocumentManager
from RevitServices.Transactions import TransactionManager

# Import RevitAPI
clr.AddReference('RevitAPI')
import Autodesk
# Import Revit Nodes ¿?
clr.AddReference("RevitNodes")
import Revit
# Import from Revit DB
from Autodesk.Revit.DB import *
doc = DocumentManager.Instance.CurrentDBDocument
#The inputs to this node will be stored as a list in the IN variables.
dataEnteringNode = IN

input = UnwrapElement(IN[0])
creator = []
lastChange = []
for i in input:
	creator.Add( WorksharingUtils.GetWorksharingTooltipInfo(doc, i.Id).Creator)
	lastChange.Add(WorksharingUtils.GetWorksharingTooltipInfo(doc, i.Id).LastChangedBy)
	
#Assign your output to the OUT variable.
OUT = creator, lastChange
# ----------------------------------------
firstItem = List.FirstItem(list=python_script_2)
groupByKey_3 = List.GroupByKey(list=firstItem, keys=filterByBoolMask_3.out)

# group (continued): placed Views
addItemToEnd_6 = List.AddItemToEnd(item=code_block_10, list=groupByKey_3.groups@L2)
flatten_7 = List.Flatten(list=addItemToEnd_6)
sheet_3 = Watch(flatten_7)

addItemToFront_6 = List.AddItemToFront(item=code_block_16, list=sheet_3)
code_block_17 = CodeBlock { "User Name"; }
code_block_18 = CodeBlock { "User Name"; }
getParameterValueByName_5 = Element.GetParameterValueByName(element=groupByKey.groups, parameterName=code_block_18)

# group (continued): placed Views
addItemToEnd_7 = List.AddItemToEnd(item=code_block_10, list=getParameterValueByName_5@L2)
flatten_8 = List.Flatten(list=addItemToEnd_7)
sheet_4 = Watch(flatten_8)

addItemToFront_7 = List.AddItemToFront(item=code_block_17, list=sheet_4)
list_create_3 = List.Create(item0=addItemToFront, item1=addItemToFront_2, item2=addItemToFront_3, item3=addItemToFront_4, item4=addItemToFront_5, item5=addItemToFront_6, item6=addItemToFront_7)
transpose_2 = List.Transpose(lists=list_create_3)
boolean_2 = BoolSelector(false)  # graph input
exportExcel = Data.ExportExcel(filePath=file_path, sheetName=string, startRow=code_block_5, startCol=code_block_5, data=transpose_2, overWrite=boolean_2)
string_2 = StringInput("Legends")  # graph input
code_block_19 = CodeBlock { "Legend Names"; }
addItemToFront_8 = List.AddItemToFront(item=code_block_19, list=legend_names)
code_block_20 = CodeBlock { "Legend Scale"; }
addItemToFront_9 = List.AddItemToFront(item=code_block_20, list=legend_scale)
list_create_4 = List.Create(item0=addItemToFront_8, item1=addItemToFront_9)
transpose_3 = List.Transpose(lists=list_create_4)
exportExcel_2 = Data.ExportExcel(filePath=file_path, sheetName=string_2, startRow=code_block_5, startCol=code_block_5, data=transpose_3, overWrite=boolean_2)
string_3 = StringInput("Schedules")  # graph input
code_block_21 = CodeBlock { "Schedule Names"; }

# group: Schedules
categories_4 = Categories(index=432)
all_elements_of_category_4 = ElementsOfCategory(Category=categories_4)
name_7 = Element.Name(element=all_elements_of_category_4)
schedule_names = Watch(name_7)

addItemToFront_10 = List.AddItemToFront(item=code_block_21, list=schedule_names)
exportExcel_3 = Data.ExportExcel(filePath=file_path, sheetName=string_3, startRow=code_block_5, startCol=code_block_5, data=addItemToFront_10, overWrite=boolean_2)
string_4 = StringInput("Sheets")  # graph input
code_block_22 = CodeBlock { "Sheet Names"; }

# group: Sheets
categories_5 = Categories(index=447)
all_elements_of_category_5 = ElementsOfCategory(Category=categories_5)
code_block_23 = CodeBlock { "Sheet Number"; }
code_block_24 = CodeBlock { "Scale"; }
code_block_25 = CodeBlock { "Discipline Name"; }
code_block_26 = CodeBlock { "Appears In Sheet List"; }
code_block_27 = CodeBlock { "Sheet Issue Date"; }

flatten_9 = List.Flatten(list=all_elements_of_category_5)

# group (continued): Sheets
name_8 = Element.Name(element=flatten_9)
sheet_names = Watch(name_8)
getParameterValueByName_6 = Element.GetParameterValueByName(element=flatten_9, parameterName=code_block_23)
sheet_parameter = Watch(getParameterValueByName_6)
getParameterValueByName_7 = Element.GetParameterValueByName(element=flatten_9, parameterName=code_block_24)
sheet_parameter_2 = Watch(getParameterValueByName_7)
getParameterValueByName_8 = Element.GetParameterValueByName(element=flatten_9, parameterName=code_block_25)
sheet_parameter_3 = Watch(getParameterValueByName_8)
getParameterValueByName_9 = Element.GetParameterValueByName(element=flatten_9, parameterName=code_block_26)
sheet_parameter_4 = Watch(getParameterValueByName_9)
getParameterValueByName_10 = Element.GetParameterValueByName(element=flatten_9, parameterName=code_block_27)
sheet_parameter_5 = Watch(getParameterValueByName_10)

addItemToFront_11 = List.AddItemToFront(item=code_block_22, list=sheet_names)
addItemToFront_12 = List.AddItemToFront(item=code_block_23, list=sheet_parameter)
addItemToFront_13 = List.AddItemToFront(item=code_block_24, list=sheet_parameter_2)
addItemToFront_14 = List.AddItemToFront(item=code_block_25, list=sheet_parameter_3)
addItemToFront_15 = List.AddItemToFront(item=code_block_26, list=sheet_parameter_4)
addItemToFront_16 = List.AddItemToFront(item=code_block_27, list=sheet_parameter_5)
code_block_28 = CodeBlock { "Revisions on Sheet"; }
revisions = archilab.Revit.Views.Sheets.Revisions(sheet=flatten_9)
name_9 = Element.Name(element=revisions)
string_from_array = FromArray(arr=name_9)
code_block_29 = CodeBlock { "{"; }
split_2 = String.Split(str=string_from_array, separater0=code_block_29)
code_block_30 = CodeBlock { 0; }
length = String.Length(str=split_2)
code_block_31 = CodeBlock(x=length) { x-2; }
substring = String.Substring(str=split_2, startIndex=code_block_30, length=code_block_31)

# group (continued): Sheets
sheet_parameter_6 = Watch(substring)

addItemToFront_17 = List.AddItemToFront(item=code_block_28, list=sheet_parameter_6)
list_create_5 = List.Create(item0=addItemToFront_11, item1=addItemToFront_12, item2=addItemToFront_13, item3=addItemToFront_14, item4=addItemToFront_15, item5=addItemToFront_16, item6=addItemToFront_17)
transpose_4 = List.Transpose(lists=list_create_5)
exportExcel_4 = Data.ExportExcel(filePath=file_path, sheetName=string_4, startRow=code_block_5, startCol=code_block_5, data=transpose_4, overWrite=boolean_2)
string_5 = StringInput("Revision")  # graph input
code_block_32 = CodeBlock { "Revision Names"; }

# group: Revision Clouds
categories_6 = Categories(index=404)
all_elements_of_category_6 = ElementsOfCategory(Category=categories_6)
name_10 = Element.Name(element=all_elements_of_category_6)
revision_names = Watch(name_10)
code_block_33 = CodeBlock { "Revision Number"; }
getParameterValueByName_11 = Element.GetParameterValueByName(element=all_elements_of_category_6, parameterName=code_block_33)
sheet_parameter_7 = Watch(getParameterValueByName_11)
code_block_34 = CodeBlock { "Revision Date"; }
getParameterValueByName_12 = Element.GetParameterValueByName(element=all_elements_of_category_6, parameterName=code_block_34)
sheet_parameter_8 = Watch(getParameterValueByName_12)
code_block_35 = CodeBlock { "Revision Description"; }
getParameterValueByName_13 = Element.GetParameterValueByName(element=all_elements_of_category_6, parameterName=code_block_35)
sheet_parameter_9 = Watch(getParameterValueByName_13)
code_block_36 = CodeBlock { "Issued to"; }
getParameterValueByName_14 = Element.GetParameterValueByName(element=all_elements_of_category_6, parameterName=code_block_36)
sheet_parameter_10 = Watch(getParameterValueByName_14)
code_block_37 = CodeBlock { "Issued by"; }
getParameterValueByName_15 = Element.GetParameterValueByName(element=all_elements_of_category_6, parameterName=code_block_37)
sheet_parameter_11 = Watch(getParameterValueByName_15)

addItemToFront_18 = List.AddItemToFront(item=code_block_32, list=revision_names)
addItemToFront_19 = List.AddItemToFront(item=code_block_33, list=sheet_parameter_7)
addItemToFront_20 = List.AddItemToFront(item=code_block_34, list=sheet_parameter_8)
addItemToFront_21 = List.AddItemToFront(item=code_block_35, list=sheet_parameter_9)
addItemToFront_22 = List.AddItemToFront(item=code_block_36, list=sheet_parameter_10)
addItemToFront_23 = List.AddItemToFront(item=code_block_37, list=sheet_parameter_11)
list_create_6 = List.Create(item0=addItemToFront_18, item1=addItemToFront_19, item2=addItemToFront_20, item3=addItemToFront_21, item4=addItemToFront_22, item5=addItemToFront_23)
transpose_5 = List.Transpose(lists=list_create_6)
exportExcel_5 = Data.ExportExcel(filePath=file_path, sheetName=string_5, startRow=code_block_5, startCol=code_block_5, data=transpose_5, overWrite=boolean_2)
code_block_38 = CodeBlock { "Legend Scale"; }
string_6 = StringInput("Materials")  # graph input
code_block_39 = CodeBlock { "Material Names"; }

# group: Materials
categories_7 = Categories(index=296)
all_elements_of_category_7 = ElementsOfCategory(Category=categories_7)
name_11 = Element.Name(element=all_elements_of_category_7)
revision_names_2 = Watch(name_11)
code_block_40 = CodeBlock { "Description"; }
getParameterValueByName_16 = Element.GetParameterValueByName(element=all_elements_of_category_7, parameterName=code_block_40)
sheet_parameter_12 = Watch(getParameterValueByName_16)

addItemToFront_24 = List.AddItemToFront(item=code_block_39, list=revision_names_2)
addItemToFront_25 = List.AddItemToFront(item=code_block_40, list=sheet_parameter_12)
list_create_7 = List.Create(item0=addItemToFront_24, item1=addItemToFront_25)
transpose_6 = List.Transpose(lists=list_create_7)
exportExcel_6 = Data.ExportExcel(filePath=file_path, sheetName=string_6, startRow=code_block_5, startCol=code_block_5, data=transpose_6, overWrite=boolean_2)
string_7 = StringInput("Project Parameters")  # graph input
code_block_41 = CodeBlock { "Parameter Names"; }

# group: Project Parameters
boolean_3 = BoolSelector(true)
code_block_42 = CodeBlock { null; }
python_get_project_parameters = Python(IN[0]=boolean_3, IN[1]=code_block_42)
# ---------- python_get_project_parameters.python (59 lines) ----------
import clr
clr.AddReference('RevitAPI')
from Autodesk.Revit.DB import *
import Autodesk

clr.AddReference("RevitNodes")
import Revit
clr.ImportExtensions(Revit.Elements)

clr.AddReference("RevitServices")
import RevitServices
from RevitServices.Persistence import DocumentManager

inputdoc = UnwrapElement(IN[1])
if inputdoc == None:
	doc = DocumentManager.Instance.CurrentDBDocument
elif inputdoc.GetType().ToString() == "Autodesk.Revit.DB.RevitLinkInstance":
	doc = inputdoc.GetLinkDocument()
elif inputdoc.GetType().ToString() == "Autodesk.Revit.DB.Document":
	doc = inputdoc
else: doc = None

names = []
cats = []
vag = []
pgs = []
pts = []
uts = []
isvis = []
elems = []
guids = []
isinst = []
iterator = doc.ParameterBindings.ForwardIterator()
while iterator.MoveNext():
	vag.append(iterator.Key.VariesAcrossGroups)
	names.append(iterator.Key.Name)
	pgs.append(iterator.Key.ParameterGroup)
	pts.append(iterator.Key.ParameterType)
	uts.append(iterator.Key.UnitType)
	isvis.append(iterator.Key.Visible)
	elem = doc.GetElement(iterator.Key.Id)
	elems.append(elem)
	if elem.GetType().ToString() == 'Autodesk.Revit.DB.SharedParameterElement':
		guids.append(elem.GuidValue)
	else: guids.append(None)
	if iterator.Current.GetType().ToString() == 'Autodesk.Revit.DB.InstanceBinding':
		isinst.append(True)
	else:
		isinst.append(False)
	thesecats = []
	for cat in iterator.Current.Categories:
		try:
			thesecats.append(Revit.Elements.Category.ById(cat.Id.IntegerValue))
		except:
			# Return null if category is not supported by Dynamo
			# This way the user knows there are unsupported categories assigned
			thesecats.append(None)
	cats.append(thesecats)
OUT = (names,cats,vag, pgs, pts, uts, isvis, elems, guids, isinst)
# ----------------------------------------
code_block_43 = CodeBlock(seq=python_get_project_parameters) { seq[0]; seq[1]; seq[3]; seq[4]; }
watch = Watch(code_block_43.out0)
watch_2 = Watch(code_block_43.out2)
watch_3 = Watch(code_block_43.out3)
code_block_44 = CodeBlock { " - "; }
string_from_object = FromObject(obj=code_block_43.out1)

addItemToFront_26 = List.AddItemToFront(item=code_block_41, list=watch)
code_block_45 = CodeBlock { "Parameter Type"; }
addItemToFront_27 = List.AddItemToFront(item=code_block_45, list=watch_2)
code_block_46 = CodeBlock { "Parameter Group"; }
addItemToFront_28 = List.AddItemToFront(item=code_block_46, list=watch_3)
code_block_47 = CodeBlock { "Parameter Catagory"; }
join = String.Join(separator=code_block_44, string0=string_from_object)

# group (continued): Project Parameters
flatten_10 = List.Flatten(list=join)
watch_4 = Watch(flatten_10)

addItemToFront_29 = List.AddItemToFront(item=code_block_47, list=watch_4)
list_create_8 = List.Create(item0=addItemToFront_26, item1=addItemToFront_27, item2=addItemToFront_28, item3=addItemToFront_29)
transpose_7 = List.Transpose(lists=list_create_8)
exportExcel_7 = Data.ExportExcel(filePath=file_path, sheetName=string_7, startRow=code_block_5, startCol=code_block_5, data=transpose_7, overWrite=boolean_2)
string_8 = StringInput("Global Parameters")  # graph input
code_block_48 = CodeBlock { "Parameter Names"; }

# group: Global Parameters
element_types = ElementTypes(index=140)
all_elements_of_type = ElementsOfType(element_type=element_types)
name_12 = Element.Name(element=all_elements_of_type)
watch_5 = Watch(name_12)
value = GlobalParameter.Value(globalParameter=all_elements_of_type)
watch_6 = Watch(value)
parameterType = GlobalParameter.ParameterType(globalParameter=all_elements_of_type)
watch_7 = Watch(parameterType)
parameterGroup = GlobalParameter.ParameterGroup(globalParameter=all_elements_of_type)
watch_8 = Watch(parameterGroup)

addItemToFront_30 = List.AddItemToFront(item=code_block_48, list=watch_5)
code_block_49 = CodeBlock { "Parameter Value"; }
addItemToFront_31 = List.AddItemToFront(item=code_block_49, list=watch_6)
code_block_50 = CodeBlock { "Parameter Type"; }
addItemToFront_32 = List.AddItemToFront(item=code_block_50, list=watch_7)
code_block_51 = CodeBlock { "Parameter Group"; }
addItemToFront_33 = List.AddItemToFront(item=code_block_51, list=watch_8)
list_create_9 = List.Create(item0=addItemToFront_30, item1=addItemToFront_31, item2=addItemToFront_32, item3=addItemToFront_33)
transpose_8 = List.Transpose(lists=list_create_9)
exportExcel_8 = Data.ExportExcel(filePath=file_path, sheetName=string_8, startRow=code_block_5, startCol=code_block_5, data=transpose_8, overWrite=boolean_2)
string_9 = StringInput("Project Phases")  # graph input

# group: Project Phases
element_types_2 = ElementTypes(index=228)
all_elements_of_type_2 = ElementsOfType(element_type=element_types_2)
name_13 = Family.Name(family=all_elements_of_type_2)
watch_9 = Watch(name_13)

exportExcel_9 = Data.ExportExcel(filePath=file_path, sheetName=string_9, startRow=code_block_5, startCol=code_block_5, data=watch_9, overWrite=boolean_2)
string_10 = StringInput("Phase Filters")  # graph input

# group: Phase Filters
element_types_3 = ElementTypes(index=229)
all_elements_of_type_3 = ElementsOfType(element_type=element_types_3)
name_14 = Family.Name(family=all_elements_of_type_3)
watch_10 = Watch(name_14)

exportExcel_10 = Data.ExportExcel(filePath=file_path, sheetName=string_10, startRow=code_block_5, startCol=code_block_5, data=watch_10, overWrite=boolean_2)
string_11 = StringInput("Links")  # graph input
code_block_52 = CodeBlock { "Link File"; }
addItemToFront_34 = List.AddItemToFront(item=code_block_52, list=file_name)
code_block_53 = CodeBlock { "Link Name"; }
addItemToFront_35 = List.AddItemToFront(item=code_block_53, list=link_name)
code_block_54 = CodeBlock { "Location Type"; }
addItemToFront_36 = List.AddItemToFront(item=code_block_54, list=location_type)
code_block_55 = CodeBlock { "Link Path"; }
addItemToFront_37 = List.AddItemToFront(item=code_block_55, list=link_path)
code_block_56 = CodeBlock { "Link Angle"; }
addItemToFront_38 = List.AddItemToFront(item=code_block_56, list=projectPosition.Angle_degr)
code_block_57 = CodeBlock { "Link Elevation"; }
addItemToFront_39 = List.AddItemToFront(item=code_block_57, list=projectPosition.Elevation)
code_block_58 = CodeBlock { "Link EastWest"; }
addItemToFront_40 = List.AddItemToFront(item=code_block_58, list=projectPosition.EastWest)
code_block_59 = CodeBlock { "Link NorthSouth"; }
addItemToFront_41 = List.AddItemToFront(item=code_block_59, list=projectPosition.NorthSouth)
code_block_60 = CodeBlock { "Link ID"; }
id_2 = Element.Id(element=all_elements_of_category)

# group (continued): Links
link_id = Watch(id_2)

addItemToFront_42 = List.AddItemToFront(item=code_block_60, list=link_id)
list_create_10 = List.Create(item0=addItemToFront_34, item1=addItemToFront_35, item2=addItemToFront_36, item3=addItemToFront_37, item4=addItemToFront_38, item5=addItemToFront_39, item6=addItemToFront_40, item7=addItemToFront_41, item8=addItemToFront_42)
transpose_9 = List.Transpose(lists=list_create_10)
exportExcel_11 = Data.ExportExcel(filePath=file_path, sheetName=string_11, startRow=code_block_5, startCol=code_block_5, data=transpose_9, overWrite=boolean_2)
string_12 = StringInput("Imports")  # graph input
code_block_61 = CodeBlock { "Import Name"; }

# group: Imports
element_types_4 = ElementTypes(index=160)
all_elements_of_type_4 = ElementsOfType(element_type=element_types_4)
code_block_62 = CodeBlock { "Name"; }
getParameterValueByName_17 = Element.GetParameterValueByName(element=all_elements_of_type_4, parameterName=code_block_62)
import_name = Watch(getParameterValueByName_17)
parameters = Element.Parameters(element=all_elements_of_type_4)
name_15 = Parameter.Name(parameter=parameters)
code_block_63 = CodeBlock { "Workset"; }
contains = String.Contains(str=name_15@L2, searchFor=code_block_63)
filterByBoolMask_4 = List.FilterByBoolMask(list=parameters, mask=contains)
string_from_object_2 = FromObject(obj=filterByBoolMask_4.in)
flatten_11 = List.Flatten(list=string_from_object_2)
code_block_64 = CodeBlock { " : "; }
split_3 = String.Split(str=flatten_11, separater0=code_block_64)
code_block_65 = CodeBlock { 1; }
getItemAtIndex_4 = List.GetItemAtIndex(list=split_3@L2, index=code_block_65)
import_workset_view = Watch(getItemAtIndex_4)
isLinked = Custom[ImportInstance.IsLinked](importInstance=all_elements_of_type_4)  # Determines whether an ImportInstance is linked or not
instance_is_linked = Watch(isLinked)

addItemToFront_43 = List.AddItemToFront(item=code_block_61, list=import_name)
code_block_66 = CodeBlock { "Import Workset"; }
addItemToFront_44 = List.AddItemToFront(item=code_block_66, list=import_workset_view)
code_block_67 = CodeBlock { "Is Linked"; }
addItemToFront_45 = List.AddItemToFront(item=code_block_67, list=instance_is_linked)
list_create_11 = List.Create(item0=addItemToFront_43, item1=addItemToFront_44, item2=addItemToFront_45)
transpose_10 = List.Transpose(lists=list_create_11)
exportExcel_12 = Data.ExportExcel(filePath=file_path, sheetName=string_12, startRow=code_block_5, startCol=code_block_5, data=transpose_10, overWrite=boolean_2)
string_13 = StringInput("Workset")  # graph input
code_block_68 = CodeBlock { "Workset Name"; }
addItemToFront_46 = List.AddItemToFront(item=code_block_68, list=workset_name)
exportExcel_13 = Data.ExportExcel(filePath=file_path, sheetName=string_13, startRow=code_block_5, startCol=code_block_5, data=addItemToFront_46, overWrite=boolean_2)
string_14 = StringInput("Filters")  # graph input
code_block_69 = CodeBlock { "Unused Filter"; }

# group: Filters
element_types_5 = ElementTypes(index=127)
all_elements_of_type_5 = ElementsOfType(element_type=element_types_5)
name_16 = Element.Name(element=all_elements_of_type_5)
categories_8 = Categories(index=602)
all_elements_of_category_8 = ElementsOfCategory(Category=categories_8)
filters = View.Filters(view=all_elements_of_category_8)
id_3 = Element.Id(element=filters)
flatten_12 = List.Flatten(list=id_3)
uniqueItems = List.UniqueItems(list=flatten_12)
list_create_12 = List.Create()  # unwired: item0
map_2 = List.Map(list=uniqueItems, f_x=list_create_12)
id_4 = Element.Id(element=all_elements_of_type_5)
eq_2 = map_2@L2 == id_4  # lacing=CrossProduct
flatten_13 = List.Flatten(list=eq_2@L3)
transpose_11 = List.Transpose(lists=flatten_13)
allFalse = List.AllFalse(list=transpose_11@L2)
filterByBoolMask_5 = List.FilterByBoolMask(list=name_16, mask=allFalse)
unused_filters = Watch(filterByBoolMask_5.in)
used_filter = Watch(filterByBoolMask_5.out)

addItemToFront_47 = List.AddItemToFront(item=code_block_69, list=unused_filters)
code_block_70 = CodeBlock { "Used Filter"; }
addItemToFront_48 = List.AddItemToFront(item=code_block_70, list=used_filter)
list_create_13 = List.Create(item0=addItemToFront_47, item1=addItemToFront_48)
transpose_12 = List.Transpose(lists=list_create_13)
exportExcel_14 = Data.ExportExcel(filePath=file_path, sheetName=string_14, startRow=code_block_5, startCol=code_block_5, data=transpose_12, overWrite=boolean_2)
string_15 = StringInput("View Template")  # graph input
code_block_71 = CodeBlock { "Unused Template"; }

# group: View Templates
view_type = ViewTypesUi(index=23)
getByType = archilab.Revit.Views.Views.GetByType(viewType=view_type)
categories_9 = Categories(index=602)
all_elements_of_category_9 = ElementsOfCategory(Category=categories_9)
viewTemplate_2 = archilab.Revit.Views.Views.ViewTemplate(view=all_elements_of_category_9)
id_5 = Element.Id(element=viewTemplate_2)
groupByKey_4 = List.GroupByKey(list=viewTemplate_2, keys=id_5)
list_create_14 = List.Create()  # unwired: item0
map_3 = List.Map(list=groupByKey_4.unique_keys, f_x=list_create_14)
id_6 = Element.Id(element=getByType)
eq_3 = map_3@L2 == id_6  # lacing=CrossProduct
flatten_14 = List.Flatten(list=eq_3@L3)
transpose_13 = List.Transpose(lists=flatten_14)
allFalse_2 = List.AllFalse(list=transpose_13@L2)
filterByBoolMask_6 = List.FilterByBoolMask(list=getByType, mask=allFalse_2)
unused_view_template = Watch(filterByBoolMask_6.in)
used_view_template = Watch(filterByBoolMask_6.out)

addItemToFront_49 = List.AddItemToFront(item=code_block_71, list=unused_view_template)
code_block_72 = CodeBlock { "Used Template"; }
addItemToFront_50 = List.AddItemToFront(item=code_block_72, list=used_view_template)
list_create_15 = List.Create(item0=addItemToFront_49, item1=addItemToFront_50)
transpose_14 = List.Transpose(lists=list_create_15)
exportExcel_15 = Data.ExportExcel(filePath=file_path, sheetName=string_15, startRow=code_block_5, startCol=code_block_5, data=transpose_14, overWrite=boolean_2)
string_16 = StringInput("Furniture")  # graph input
code_block_73 = CodeBlock { "Furniture Name"; }

# group: Furniture
categories_10 = Categories(index=222)
all_elements_of_category_10 = ElementsOfCategory(Category=categories_10)
name_17 = Element.Name(element=all_elements_of_category_10)
groupByKey_5 = List.GroupByKey(list=all_elements_of_category_10, keys=name_17)
furniture_name = Watch(groupByKey_5.unique_keys)
count = List.Count(list=groupByKey_5.groups@L2)
furniture_count = Watch(count)

addItemToFront_51 = List.AddItemToFront(item=code_block_73, list=furniture_name)
code_block_74 = CodeBlock { "Count"; }
addItemToFront_52 = List.AddItemToFront(item=code_block_74, list=furniture_count)
list_create_16 = List.Create(item0=addItemToFront_51, item1=addItemToFront_52)
transpose_15 = List.Transpose(lists=list_create_16)
exportExcel_16 = Data.ExportExcel(filePath=file_path, sheetName=string_16, startRow=code_block_5, startCol=code_block_5, data=transpose_15, overWrite=boolean_2)
string_17 = StringInput("Shared Parameters")  # graph input
code_block_75 = CodeBlock { "Shared Parameter Location"; }
sharedParameterFile = Parameter.SharedParameterFile()
watch_11 = Watch(sharedParameterFile)
addItemToFront_53 = List.AddItemToFront(item=code_block_75, list=watch_11)
code_block_76 = CodeBlock { "Parameter Names"; }

# group: Shared Parameters
element_types_6 = ElementTypes(index=278)
all_elements_of_type_6 = ElementsOfType(element_type=element_types_6)
name_18 = Family.Name(family=all_elements_of_type_6)
watch_12 = Watch(name_18)

addItemToFront_54 = List.AddItemToFront(item=code_block_76, list=watch_12)
list_create_17 = List.Create(item0=addItemToFront_53, item1=addItemToFront_54)
transpose_16 = List.Transpose(lists=list_create_17)
exportExcel_17 = Data.ExportExcel(filePath=file_path, sheetName=string_17, startRow=code_block_5, startCol=code_block_5, data=transpose_16, overWrite=boolean_2)
string_18 = StringInput("Inplace Families")  # graph input
code_block_77 = CodeBlock { "InPlace Family Name"; }

# group: Families
element_types_7 = ElementTypes(index=119)
all_elements_of_type_7 = ElementsOfType(element_type=element_types_7)
isInPlace = Custom[Family.IsInPlace](family=all_elements_of_type_7)  # Determines if a family is an in-place family
filterByBoolMask_7 = List.FilterByBoolMask(list=all_elements_of_type_7, mask=isInPlace)
list_create_18 = List.Create()  # unwired: item0
map_4 = List.Map(list=filterByBoolMask_7.in, f_x=list_create_18)
code_block_78 = CodeBlock { null; }
types = Family.Types(family=filterByBoolMask_7.in)
count_2 = List.Count(list=types@L2)
code_block_79 = CodeBlock { 1; }
max = Math.Max(value1=count_2, value2=code_block_79)
ofRepeatedItem = List.OfRepeatedItem(item=code_block_78, amount=max)
restOfItems = List.RestOfItems(list=ofRepeatedItem@L2)
addItemToFront_55 = List.AddItemToFront(item=map_4@L2, list=restOfItems@L2)
flatten_15 = List.Flatten(list=addItemToFront_55)
code_block_80 = CodeBlock { " "; }
replaceNulls_2 = Lists.Manage.ReplaceNulls(Data=flatten_15, ReplaceWith=code_block_80)
replaceEmptyLists = Custom[List.ReplaceEmptyLists](seq=types@L2, Replacement=code_block_78)  # Replaces all empty lists within a given list with a substitute
flatten_16 = List.Flatten(list=replaceEmptyLists)
replaceNulls_3 = Lists.Manage.ReplaceNulls(Data=flatten_16, ReplaceWith=code_block_80)
string_from_object_3 = FromObject(obj=replaceNulls_3)
inplace_family_type = Watch(string_from_object_3)
list_create_19 = List.Create()  # unwired: item0
map_5 = List.Map(list=filterByBoolMask_7.out, f_x=list_create_19)
code_block_81 = CodeBlock { null; }
types_2 = Family.Types(family=filterByBoolMask_7.out)
count_3 = List.Count(list=types_2@L2)
code_block_82 = CodeBlock { 1; }
max_2 = Math.Max(value1=count_3, value2=code_block_82)
ofRepeatedItem_2 = List.OfRepeatedItem(item=code_block_81, amount=max_2)
restOfItems_2 = List.RestOfItems(list=ofRepeatedItem_2@L2)
addItemToFront_56 = List.AddItemToFront(item=map_5@L2, list=restOfItems_2@L2)
flatten_17 = List.Flatten(list=addItemToFront_56)
code_block_83 = CodeBlock { " "; }
replaceNulls_4 = Lists.Manage.ReplaceNulls(Data=flatten_17, ReplaceWith=code_block_83)
string_from_object_4 = FromObject(obj=replaceNulls_4)
other_family = Watch(string_from_object_4)
replaceEmptyLists_2 = Custom[List.ReplaceEmptyLists](seq=types_2@L2, Replacement=code_block_81)
flatten_18 = List.Flatten(list=replaceEmptyLists_2)
replaceNulls_5 = Lists.Manage.ReplaceNulls(Data=flatten_18, ReplaceWith=code_block_83)
string_from_object_5 = FromObject(obj=replaceNulls_5)
other_family_type = Watch(string_from_object_5)

name_19 = Element.Name(element=replaceNulls_2)

# group (continued): Families
string_from_object_6 = FromObject(obj=name_19)
inplace_family = Watch(string_from_object_6)

addItemToFront_57 = List.AddItemToFront(item=code_block_77, list=inplace_family)
code_block_84 = CodeBlock { "InPlace Family Type"; }
addItemToFront_58 = List.AddItemToFront(item=code_block_84, list=inplace_family_type)
list_create_20 = List.Create(item0=addItemToFront_57, item1=addItemToFront_58)
transpose_17 = List.Transpose(lists=list_create_20)
exportExcel_18 = Data.ExportExcel(filePath=file_path, sheetName=string_18, startRow=code_block_5, startCol=code_block_5, data=transpose_17, overWrite=boolean_2)
string_19 = StringInput("Families")  # graph input
code_block_85 = CodeBlock { "Family Name"; }
addItemToFront_59 = List.AddItemToFront(item=code_block_85, list=other_family)
code_block_86 = CodeBlock { "Family Type"; }
addItemToFront_60 = List.AddItemToFront(item=code_block_86, list=other_family_type)
list_create_21 = List.Create(item0=addItemToFront_59, item1=addItemToFront_60)
transpose_18 = List.Transpose(lists=list_create_21)
exportExcel_19 = Data.ExportExcel(filePath=file_path, sheetName=string_19, startRow=code_block_5, startCol=code_block_5, data=transpose_18, overWrite=boolean_2)
string_20 = StringInput("Images")  # graph input
code_block_87 = CodeBlock { "Image Name"; }

# group: images
code_block_88 = CodeBlock { Category.ByName("Raster Images"); }
all_elements_of_category_11 = ElementsOfCategory(Category=code_block_88)
code_block_89 = CodeBlock { "Type"; }
getParameterValueByName_18 = Element.GetParameterValueByName(element=all_elements_of_category_11, parameterName=code_block_89)
name_20 = Element.Name(element=getParameterValueByName_18)
code_block_90 = CodeBlock { "Width (pixels)"; }
getParameterValueByName_19 = Element.GetParameterValueByName(element=getParameterValueByName_18, parameterName=code_block_90)
code_block_91 = CodeBlock { "Height (pixels)"; }
getParameterValueByName_20 = Element.GetParameterValueByName(element=getParameterValueByName_18, parameterName=code_block_91)
mul = getParameterValueByName_19 * getParameterValueByName_20
sortByKey = List.SortByKey(list=name_20, keys=mul)
reverse = List.Reverse(list=sortByKey.sorted_list)
all_images = Watch(reverse)
reverse_2 = List.Reverse(list=sortByKey.sorted_keys)
pixel_count_all_images = Watch(reverse_2)

addItemToFront_61 = List.AddItemToFront(item=code_block_87, list=all_images)
code_block_92 = CodeBlock { "Pixels"; }
addItemToFront_62 = List.AddItemToFront(item=code_block_92, list=pixel_count_all_images)
list_create_22 = List.Create(item0=addItemToFront_61, item1=addItemToFront_62)
transpose_19 = List.Transpose(lists=list_create_22)
exportExcel_20 = Data.ExportExcel(filePath=file_path, sheetName=string_20, startRow=code_block_5, startCol=code_block_5, data=transpose_19, overWrite=boolean_2)
string_21 = StringInput("Detail Group")  # graph input
code_block_93 = CodeBlock { "Detail Group Name"; }

# group: Detail Groups
python_get_detail_groups = Python()  # graph input
# ---------- python_get_detail_groups.python (35 lines) ----------
#Copyright(c) 2015, Konrad Sobon
# @arch_laboratory, http://archi-lab.net

import clr
clr.AddReference('ProtoGeometry')
from Autodesk.DesignScript.Geometry import *

# Import DocumentManager and TransactionManager
clr.AddReference("RevitServices")
import RevitServices
from RevitServices.Persistence import DocumentManager
from RevitServices.Transactions import TransactionManager

# Import RevitAPI
clr.AddReference("RevitAPI")
import Autodesk
from Autodesk.Revit.DB import *

doc = DocumentManager.Instance.CurrentDBDocument
uiapp = DocumentManager.Instance.CurrentUIApplication
app = uiapp.Application

from System.Collections.Generic import *

#The inputs to this node will be stored as a list in the IN variable.
dataEnteringNode = IN

collector = FilteredElementCollector(doc)
groups = collector.OfCategory(BuiltInCategory.OST_IOSDetailGroups).WhereElementIsNotElementType().ToElements()

groupNames = []
for i in groups:
	groupNames.append(i.Name)

OUT = groupNames, groups
# ----------------------------------------
code_block_94 = CodeBlock(OUT=python_get_detail_groups) { OUT[0]; OUT[1]; }
code_block_95 = CodeBlock { "Type Id"; }
getParameterValueByName_21 = Element.GetParameterValueByName(element=code_block_94.out1, parameterName=code_block_95)
id_7 = Element.Id(element=getParameterValueByName_21)
groupByKey_6 = List.GroupByKey(list=code_block_94.out0, keys=id_7)
firstItem_2 = List.FirstItem(list=groupByKey_6.groups@L2)
detail_group_name = Watch(firstItem_2)
groupByKey_7 = List.GroupByKey(list=code_block_94.out1, keys=id_7)
firstItem_3 = List.FirstItem(list=groupByKey_7.groups@L2)
parameters_2 = Element.Parameters(element=firstItem_3)
name_21 = Parameter.Name(parameter=parameters_2)
code_block_96 = CodeBlock { "Workset"; }
contains_2 = String.Contains(str=name_21@L2, searchFor=code_block_96)
filterByBoolMask_8 = List.FilterByBoolMask(list=parameters_2, mask=contains_2)
string_from_object_7 = FromObject(obj=filterByBoolMask_8.in)
flatten_19 = List.Flatten(list=string_from_object_7)
code_block_97 = CodeBlock { " : "; }
split_4 = String.Split(str=flatten_19, separater0=code_block_97)
code_block_98 = CodeBlock { 1; }
getItemAtIndex_5 = List.GetItemAtIndex(list=split_4@L2, index=code_block_98)
detail_group_workset = Watch(getItemAtIndex_5)
count_4 = List.Count(list=groupByKey_7.groups@L2)
python_get_unused_detail_groups = Python()  # graph input
# ---------- python_get_unused_detail_groups.python (32 lines) ----------
#Copyright(c) 2015, Konrad Sobon
# @arch_laboratory, http://archi-lab.net

import clr
clr.AddReference('ProtoGeometry')
from Autodesk.DesignScript.Geometry import *

# Import DocumentManager and TransactionManager
clr.AddReference("RevitServices")
import RevitServices
from RevitServices.Persistence import DocumentManager
from RevitServices.Transactions import TransactionManager

# Import RevitAPI
clr.AddReference("RevitAPI")
import Autodesk
from Autodesk.Revit.DB import *

doc = DocumentManager.Instance.CurrentDBDocument
uiapp = DocumentManager.Instance.CurrentUIApplication
app = uiapp.Application

#The inputs to this node will be stored as a list in the IN variable.
dataEnteringNode = IN

groups = FilteredElementCollector(doc).OfClass(GroupType)
unplacedGroups = []
for i in groups:
	gInstances = i.Groups
	if gInstances.IsEmpty == 1:
		unplacedGroups.append(i)
OUT = unplacedGroups
# ----------------------------------------
name_22 = Element.Name(element=python_get_unused_detail_groups)
unused_detail_groups = Watch(name_22)

addItemToFront_63 = List.AddItemToFront(item=code_block_93, list=detail_group_name)
code_block_99 = CodeBlock { "Detail Group Workset"; }
addItemToFront_64 = List.AddItemToFront(item=code_block_99, list=detail_group_workset)
code_block_100 = CodeBlock { "Detail Group Count"; }
detail_group_count = Watch(count_4)
addItemToFront_65 = List.AddItemToFront(item=code_block_100, list=detail_group_count)
code_block_101 = CodeBlock { "Unused Detail Groups"; }
addItemToFront_66 = List.AddItemToFront(item=code_block_101, list=unused_detail_groups)
list_create_23 = List.Create(item0=addItemToFront_63, item1=addItemToFront_64, item2=addItemToFront_65, item3=addItemToFront_66)
transpose_20 = List.Transpose(lists=list_create_23)
code_block_102 = CodeBlock { " "; }
replaceNulls_6 = Lists.Manage.ReplaceNulls(Data=transpose_20, ReplaceWith=code_block_102)
exportExcel_21 = Data.ExportExcel(filePath=file_path, sheetName=string_21, startRow=code_block_5, startCol=code_block_5, data=replaceNulls_6, overWrite=boolean_2)
string_22 = StringInput("Model Group")  # graph input
code_block_103 = CodeBlock { "Model Group Name"; }

# group: Model Groups
categories_11 = Categories(index=326)
all_elements_of_category_12 = ElementsOfCategory(Category=categories_11)
code_block_104 = CodeBlock { "Type Id"; }
getParameterValueByName_22 = Element.GetParameterValueByName(element=all_elements_of_category_12, parameterName=code_block_104)
code_block_105 = CodeBlock { "Workset"; }
code_block_106 = CodeBlock { " : "; }
code_block_107 = CodeBlock { 1; }

groupByKey_8 = List.GroupByKey(list=all_elements_of_category_12, keys=getParameterValueByName_22)
firstItem_4 = List.FirstItem(list=groupByKey_8.groups@L2)

# group (continued): Model Groups
name_23 = Element.Name(element=firstItem_4)
model_group_workset = Watch(name_23)
parameters_3 = Element.Parameters(element=firstItem_4)
name_24 = Parameter.Name(parameter=parameters_3)
contains_3 = String.Contains(str=name_24@L2, searchFor=code_block_105)
filterByBoolMask_9 = List.FilterByBoolMask(list=parameters_3, mask=contains_3)
string_from_object_8 = FromObject(obj=filterByBoolMask_9.in)
flatten_20 = List.Flatten(list=string_from_object_8)
split_5 = String.Split(str=flatten_20, separater0=code_block_106)
getItemAtIndex_6 = List.GetItemAtIndex(list=split_5@L2, index=code_block_107)
model_group_workset_2 = Watch(getItemAtIndex_6)

addItemToFront_67 = List.AddItemToFront(item=code_block_103, list=model_group_workset)
code_block_108 = CodeBlock { "Model Group Workset"; }
addItemToFront_68 = List.AddItemToFront(item=code_block_108, list=model_group_workset_2)
code_block_109 = CodeBlock { "Count"; }
count_5 = List.Count(list=groupByKey_8.groups@L2)

# group (continued): Model Groups
model_group_id = Watch(count_5)

addItemToFront_69 = List.AddItemToFront(item=code_block_109, list=model_group_id)
list_create_24 = List.Create(item0=addItemToFront_67, item1=addItemToFront_68, item2=addItemToFront_69)
transpose_21 = List.Transpose(lists=list_create_24)
exportExcel_22 = Data.ExportExcel(filePath=file_path, sheetName=string_22, startRow=code_block_5, startCol=code_block_5, data=transpose_21, overWrite=boolean_2)
string_23 = StringInput("Unplaced Views")  # graph input
code_block_110 = CodeBlock { "View Names"; }

# group: Unplaced Views
code_block_111 = CodeBlock { " "; }
type_3 = archilab.Revit.Elements.Elements.Type(element=filterByBoolMask.in)
name_25 = FamilyType.Name(familyType=type_3)
isNull_2 = Object.IsNull(obj=name_25)
filterByBoolMask_10 = List.FilterByBoolMask(list=filterByBoolMask.in, mask=isNull_2)
filterByBoolMask_11 = List.FilterByBoolMask(list=name_25, mask=isNull_2)
groupByKey_9 = List.GroupByKey(list=filterByBoolMask_10.out, keys=filterByBoolMask_11.out)
name_26 = Element.Name(element=groupByKey_9.groups)
addItemToEnd_8 = List.AddItemToEnd(item=code_block_111, list=name_26@L2)
flatten_21 = List.Flatten(list=addItemToEnd_8)
view_names_2 = Watch(flatten_21)
code_block_112 = CodeBlock { " "; }
code_block_113 = CodeBlock { "1:"; "Scale Value    1:"; }
getParameterValueByName_23 = Element.GetParameterValueByName(element=groupByKey_9.groups, parameterName=code_block_113.out1)
addItemToEnd_9 = List.AddItemToEnd(item=code_block_112, list=getParameterValueByName_23@L2)
flatten_22 = List.Flatten(list=addItemToEnd_9)
view_scale_2 = Watch(flatten_22)
groupByKey_10 = List.GroupByKey(list=filterByBoolMask_11.out, keys=filterByBoolMask_11.out)
addItemToEnd_10 = List.AddItemToEnd(item=code_block_112, list=groupByKey_10.groups@L2)
flatten_23 = List.Flatten(list=addItemToEnd_10)
type_4 = Watch(flatten_23)

addItemToFront_70 = List.AddItemToFront(item=code_block_110, list=view_names_2)
code_block_114 = CodeBlock { "View Scale"; }
addItemToFront_71 = List.AddItemToFront(item=code_block_114, list=view_scale_2)
code_block_115 = CodeBlock { "Type"; }
addItemToFront_72 = List.AddItemToFront(item=code_block_115, list=type_4)
code_block_116 = CodeBlock { "Template"; }
viewTemplate_3 = archilab.Revit.Views.Views.ViewTemplate(view=groupByKey_9.groups)
name_27 = Element.Name(element=viewTemplate_3)
replaceNulls_7 = Lists.Manage.ReplaceNulls(Data=name_27, ReplaceWith=code_block_112)
addItemToEnd_11 = List.AddItemToEnd(item=code_block_112, list=replaceNulls_7@L2)
flatten_24 = List.Flatten(list=addItemToEnd_11)
sheet_5 = Watch(flatten_24)
addItemToFront_73 = List.AddItemToFront(item=code_block_116, list=sheet_5)
code_block_117 = CodeBlock { "Creator"; }
python_script_3 = Python(IN[0]=filterByBoolMask_10.out)  # same code as python_script_2
firstItem_5 = List.FirstItem(list=python_script_3)
groupByKey_11 = List.GroupByKey(list=firstItem_5, keys=filterByBoolMask_11.out)

# group (continued): Unplaced Views
addItemToEnd_12 = List.AddItemToEnd(item=code_block_112, list=groupByKey_11.groups@L2)
flatten_25 = List.Flatten(list=addItemToEnd_12)
sheet_6 = Watch(flatten_25)

addItemToFront_74 = List.AddItemToFront(item=code_block_117, list=sheet_6)
code_block_118 = CodeBlock { "User Name"; }
code_block_119 = CodeBlock { "User Name"; }
getParameterValueByName_24 = Element.GetParameterValueByName(element=groupByKey_9.groups, parameterName=code_block_119)

# group (continued): Unplaced Views
addItemToEnd_13 = List.AddItemToEnd(item=code_block_10, list=getParameterValueByName_24@L2)
flatten_26 = List.Flatten(list=addItemToEnd_13)
sheet_7 = Watch(flatten_26)

addItemToFront_75 = List.AddItemToFront(item=code_block_118, list=sheet_7)
list_create_25 = List.Create(item0=addItemToFront_70, item1=addItemToFront_71, item2=addItemToFront_72, item3=addItemToFront_73, item4=addItemToFront_74, item5=addItemToFront_75)
transpose_22 = List.Transpose(lists=list_create_25)
exportExcel_23 = Data.ExportExcel(filePath=file_path, sheetName=string_23, startRow=code_block_5, startCol=code_block_5, data=transpose_22, overWrite=boolean_2)
string_24 = StringInput("Warnings")  # graph input
code_block_120 = CodeBlock { "Warning Count"; }

# group: Warning Counts
getWarnings = archilab.Revit.Elements.Warning.GetWarnings()
errorMessage = archilab.Revit.Elements.Warning.ErrorMessage(warning=getWarnings)
groupByKey_12 = List.GroupByKey(list=errorMessage, keys=errorMessage)
count_6 = List.Count(list=groupByKey_12.groups@L2)
sortByKey_2 = List.SortByKey(list=groupByKey_12.groups, keys=count_6)
reverse_3 = List.Reverse(list=sortByKey_2.sorted_keys)
watch_13 = Watch(reverse_3)
firstItem_6 = List.FirstItem(list=sortByKey_2.sorted_list@L2)
reverse_4 = List.Reverse(list=firstItem_6)
watch_14 = Watch(reverse_4)
code_block_121 = CodeBlock { "("; ") "; }
add_2 = code_block_121.out0 + watch_13
add_3 = add_2 + code_block_121.out1
add_4 = add_3 + watch_14
watch_15 = Watch(add_4)
list_create_26 = List.Create()  # unwired: item0
map_6 = List.Map(list=watch_14, f_x=list_create_26)
groupByKey_13 = List.GroupByKey(list=getWarnings, keys=errorMessage)
sortByKey_3 = List.SortByKey(list=groupByKey_13.groups, keys=count_6)
reverse_5 = List.Reverse(list=sortByKey_3.sorted_list)
elements = archilab.Revit.Elements.Warning.Elements(warning=reverse_5)
id_8 = archilab.Revit.Elements.WarningElement.Id(warningElement=elements)
watch_16 = Watch(id_8)

addItemToFront_76 = List.AddItemToFront(item=code_block_120, list=watch_13)
code_block_122 = CodeBlock { "Warning"; }
addItemToFront_77 = List.AddItemToFront(item=code_block_122, list=watch_14)
list_create_27 = List.Create(item0=addItemToFront_76, item1=addItemToFront_77)
transpose_23 = List.Transpose(lists=list_create_27)
exportExcel_24 = Data.ExportExcel(filePath=file_path, sheetName=string_24, startRow=code_block_5, startCol=code_block_5, data=transpose_23, overWrite=boolean_2)
string_25 = StringInput("Warning Details")  # graph input
code_block_123 = CodeBlock { "Warning Detail"; }

# group: Warning Detail
code_block_124 = CodeBlock { " "; }
addItemToFront_78 = List.AddItemToFront(item=map_6@L2, list=watch_16@L3)
addItemToFront_79 = List.AddItemToFront(item=code_block_124, list=addItemToFront_78@L2)
flatten_27 = List.Flatten(list=addItemToFront_79)
restOfItems_3 = List.RestOfItems(list=flatten_27)
watch_17 = Watch(restOfItems_3)

addItemToFront_80 = List.AddItemToFront(item=code_block_123, list=watch_17)
list_create_28 = List.Create(item0=addItemToFront_80)
transpose_24 = List.Transpose(lists=list_create_28)
exportExcel_25 = Data.ExportExcel(filePath=file_path, sheetName=string_25, startRow=code_block_5, startCol=code_block_5, data=transpose_24, overWrite=boolean_2)
string_26 = StringInput("Lines and patterns")  # graph input
code_block_125 = CodeBlock { "Fill Pattern Name"; }

# group: Line and Patterns
element_types_8 = ElementTypes(index=126)
all_elements_of_type_8 = ElementsOfType(element_type=element_types_8)
name_28 = Element.Name(element=all_elements_of_type_8)
fill_pattern_name = Watch(name_28)
element_types_9 = ElementTypes(index=174)
all_elements_of_type_9 = ElementsOfType(element_type=element_types_9)
name_29 = Element.Name(element=all_elements_of_type_9)
line_pattern_name = Watch(name_29)
categories_12 = Categories(index=256)
all_elements_of_category_13 = ElementsOfCategory(Category=categories_12)
code_block_126 = CodeBlock { "Line Style"; }
getParameterValueByName_25 = Element.GetParameterValueByName(element=all_elements_of_category_13, parameterName=code_block_126)
groupByKey_14 = List.GroupByKey(list=all_elements_of_category_13, keys=getParameterValueByName_25)
name_30 = Element.Name(element=groupByKey_14.unique_keys)
line_type = Watch(name_30)
count_7 = List.Count(list=groupByKey_14.groups@L2)
line_count = Watch(count_7)

addItemToFront_81 = List.AddItemToFront(item=code_block_125, list=fill_pattern_name)
code_block_127 = CodeBlock { "Line Pattern Name"; }
addItemToFront_82 = List.AddItemToFront(item=code_block_127, list=line_pattern_name)
code_block_128 = CodeBlock { "Line Type Name"; }
addItemToFront_83 = List.AddItemToFront(item=code_block_128, list=line_type)
code_block_129 = CodeBlock { "Line Type Count"; }
addItemToFront_84 = List.AddItemToFront(item=code_block_129, list=line_count)
list_create_29 = List.Create(item0=addItemToFront_81, item1=addItemToFront_82, item2=addItemToFront_83, item3=addItemToFront_84)
transpose_25 = List.Transpose(lists=list_create_29)
code_block_130 = CodeBlock { " "; }
replaceNulls_8 = Lists.Manage.ReplaceNulls(Data=transpose_25, ReplaceWith=code_block_130)
exportExcel_26 = Data.ExportExcel(filePath=file_path, sheetName=string_26, startRow=code_block_5, startCol=code_block_5, data=replaceNulls_8, overWrite=boolean_2)
code_block_131 = CodeBlock { Angle (degr.); }
code_block_132 = CodeBlock { 0; }
getItemAtIndex_7 = List.GetItemAtIndex(list=python_script@L3, index=code_block_132)
code_block_133 = CodeBlock(seq=getItemAtIndex_7) { seq[0][2]; }
code_block_134 = CodeBlock { true; null; }
python_script_4 = Python()  # unwired: IN[0]
# ---------- python_script_4.python (12 lines) ----------
import clr
clr.AddReference("RevitServices")
import RevitServices
from RevitServices.Persistence import DocumentManager

doc = DocumentManager.Instance.CurrentDBDocument
uiapp = DocumentManager.Instance.CurrentUIApplication
app = uiapp.Application
if int(app.VersionNumber) > 2017: fullVersion = app.SubVersionNumber
else: fullVersion = str(app.VersionNumber)

OUT = app.VersionName, int(app.VersionNumber), app.VersionBuild, app.Language.ToString(), fullVersion
# ----------------------------------------
code_block_135 = CodeBlock(seq=python_script_4) { seq[1]; }
python_script_5 = Python(IN[0]=code_block_133, IN[1]=code_block_134.out1, IN[2]=code_block_135)
# ---------- python_script_5.python (27 lines) ----------
import clr
clr.AddReference('RevitAPI')
from Autodesk.Revit.DB import *
import Autodesk

clr.AddReference("RevitServices")
import RevitServices
from RevitServices.Persistence import DocumentManager

inputdoc = UnwrapElement(IN[1])
version = IN[2]
if inputdoc == None:
	doc = DocumentManager.Instance.CurrentDBDocument
elif inputdoc.GetType().ToString() == "Autodesk.Revit.DB.RevitLinkInstance":
	doc = inputdoc.GetLinkDocument()
elif inputdoc.GetType().ToString() == "Autodesk.Revit.DB.Document":
	doc = inputdoc
else: doc = None

projloc = doc.ActiveProjectLocation
if version > 2017:
	position_data = projloc.GetProjectPosition(XYZ.Zero)
	location_data = projloc.GetSiteLocation()
else:
	position_data = projloc.ProjectPosition[XYZ.Zero]
	location_data = projloc.SiteLocation
OUT = (position_data.Angle,position_data.Elevation,position_data.EastWest,position_data.NorthSouth)
# ----------------------------------------
code_block_136 = CodeBlock(seq=python_script_5) { seq[0]; seq[1]; seq[2]; seq[3]; }
unit_types = UnitTypes(index=2)  # graph input
displayUnitType = Custom[UnitType.DisplayUnitType](unitType=unit_types)  # Retrieves the display unit type for a given unit type.
toDisplayUnit = Custom[InternalUnit.ToDisplayUnit](val=code_block_136.out1, displayUnitType=displayUnitType.displayUnitType)  # Converts a value from Revit's internal unit to a given display unit
code_block_137 = CodeBlock(Elevation=toDisplayUnit) { Elevation; }
toDisplayUnit_2 = Custom[InternalUnit.ToDisplayUnit](val=code_block_136.out2, displayUnitType=displayUnitType.displayUnitType)
code_block_138 = CodeBlock(EastWest=toDisplayUnit_2) { EastWest; }
toDisplayUnit_3 = Custom[InternalUnit.ToDisplayUnit](val=code_block_136.out3, displayUnitType=displayUnitType.displayUnitType)
code_block_139 = CodeBlock(NorthSouth=toDisplayUnit_3) { NorthSouth; }
radiansToDegrees = Math.RadiansToDegrees(radians=code_block_136.out0)
