# Dynamo graph PHD Criteria_DG.dyn "PHD Criteria_APPEND_TimeStamp_v2" (Dynamo 2.0.2.6826)

# group: Legends
code_block = CodeBlock { "1:"; "Scale Value    1:"; }
boolean = BoolSelector(true)
python_legend_collector = Python(IN[0]=boolean)
# ---------- python_legend_collector.python (36 lines) ----------
#Copyright(c) 2017, john pierson
# @60secondrevit, http://sixtysecondrevit.com

import clr
clr.AddReference('ProtoGeometry')
from Autodesk.DesignScript.Geometry import *

# Import DocumentManager and TransactionManager
clr.AddReference("RevitServices")
import RevitServices
from RevitServices.Persistence import DocumentManager
from RevitServices.Transactions import TransactionManager

# Import RevitAPI
clr.AddReference("RevitAPI")
import Autodesk
from Autodesk.Revit.DB import *

doc = DocumentManager.Instance.CurrentDBDocument
uiapp = DocumentManager.Instance.CurrentUIApplication
app = uiapp.Application

from System.Collections.Generic import *


#The inputs to this node will be stored as a list in the IN variable.
dataEnteringNode = IN
collector = FilteredElementCollector(doc)
sheets = collector.OfCategory(BuiltInCategory.OST_Views).ToElements()

sheetInstances = []
for i in sheets:
	if i.ViewType.ToString() == "Legend":
		sheetInstances.append(i)

OUT = sheetInstances
# ----------------------------------------
getParameterValueByName = Element.GetParameterValueByName(element=python_legend_collector, parameterName=code_block.out1)
add = code_block.out0 + getParameterValueByName
name = Element.Name(element=python_legend_collector)
legend_names = Watch(name)
legend_scale = Watch(getParameterValueByName)

# group: Links
empty = List.Empty()
python_script = Python(IN[0]=empty)
# ---------- python_script.python (50 lines) ----------
#Copyright(c) 2015, Konrad K Sobon
# @arch_laboratory, http://archi-lab.net

# Huge thanks to Andreas Dieckmann for 
# adding link path functionality

import clr
clr.AddReference('ProtoGeometry')
from Autodesk.DesignScript.Geometry import *

# Import DocumentManager and TransactionManager
clr.AddReference("RevitServices")
import RevitServices
from RevitServices.Persistence import DocumentManager
from RevitServices.Transactions import TransactionManager

from System.Collections.Generic import *

# Import RevitAPI
clr.AddReference("RevitAPI")
import Autodesk
from Autodesk.Revit.DB import *
from Autodesk.Revit.DB.Analysis import *

doc = DocumentManager.Instance.CurrentDBDocument
uiapp = DocumentManager.Instance.CurrentUIApplication
app = uiapp.Application

# Import ToDSType(bool) extension method
clr.AddReference("RevitNodes")
import Revit
clr.ImportExtensions(Revit.Elements)

#The inputs to this node will be stored as a list in the IN variable.
dataEnteringNode = IN

collector = Autodesk.Revit.DB.FilteredElementCollector(doc)
linkInstances = collector.OfClass(Autodesk.Revit.DB.RevitLinkInstance)

linkDoc, linkName, linkPath = [], [], []
for i in linkInstances:
	linkDoc.append(i.GetLinkDocument())
	linkName.append(i.Name)
	try:
		linkPath.append(i.GetLinkDocument().PathName)
	except:
		linkPath.append(None)
		pass

OUT = linkDoc, linkName, linkInstances, linkPath
# ----------------------------------------
code_block_2 = CodeBlock(seq=python_script) { seq[0]; seq[3]; }
projectPosition = Custom[Document.ProjectPosition](docOrRevitLinkInstance=code_block_2.out0)  # Gets the project's position data relative to the origin. Output coordinates may diverge from the project base point coordinates once the project base point has been moved in an unclipped state. Use the built-in nodes Location.Latitude & Location.Longitude to retrieve latitude and longitude.
list_create = List.Create(item0=projectPosition.Angle_degr, item1=projectPosition.Elevation, item2=projectPosition.EastWest, item3=projectPosition.NorthSouth)
transpose = List.Transpose(lists=list_create)
position_data = Watch(transpose)
categories = Categories(index=430)
all_elements_of_category = ElementsOfCategory(Category=categories)
name_2 = Element.Name(element=all_elements_of_category)
code_block_3 = CodeBlock { ": "; }
split = String.Split(str=name_2, separater0=code_block_3)
code_block_4 = CodeBlock { 0; 1; 2; }
getItemAtIndex = List.GetItemAtIndex(list=split@L2, index=code_block_4.out0)
getItemAtIndex_2 = List.GetItemAtIndex(list=split@L2, index=code_block_4.out1)
getItemAtIndex_3 = List.GetItemAtIndex(list=split@L2, index=code_block_4.out2)
link_path = Watch(code_block_2.out1)

# group: Worksets
categories_2 = Categories(index=602)
all_elements_of_category_2 = ElementsOfCategory(Category=categories_2)
getAll = archilab.Revit.Elements.Workset.GetAll()
id = archilab.Revit.Elements.Workset.Id(workset=getAll)
list_create_2 = List.Create()  # unwired: item0
map = List.Map(list=id, f_x=list_create_2)
getWorksetVisibility = Rhythm.Revit.Views.View.GetWorksetVisibility(view=all_elements_of_category_2, worksetId=map@L2)
flatten = List.Flatten(list=getWorksetVisibility@L3)
visable_in_view = Watch(flatten)
name_3 = archilab.Revit.Elements.Workset.Name(workset=getAll)
workset_name = Watch(name_3)

# group: Furniture
categories_3 = Categories(index=222)
all_elements_of_category_3 = ElementsOfCategory(Category=categories_3)
name_4 = Element.Name(element=all_elements_of_category_3)
groupByKey = List.GroupByKey(list=all_elements_of_category_3, keys=name_4)
count = List.Count(list=groupByKey.groups@L2)
furniture_count = Watch(count)
furniture_name = Watch(groupByKey.unique_keys)

code_block_5 = CodeBlock { "Legend Scale"; }

# group: Model Groups
categories_4 = Categories(index=326)
all_elements_of_category_4 = ElementsOfCategory(Category=categories_4)
code_block_6 = CodeBlock { "Type Id"; }
getParameterValueByName_2 = Element.GetParameterValueByName(element=all_elements_of_category_4, parameterName=code_block_6)
name_5 = Element.Name(element=all_elements_of_category_4)
model_group_name = Watch(name_5)
parameters = Element.Parameters(element=all_elements_of_category_4)
name_6 = Parameter.Name(parameter=parameters)
code_block_7 = CodeBlock { "Workset"; }
contains = String.Contains(str=name_6@L2, searchFor=code_block_7)
filterByBoolMask = List.FilterByBoolMask(list=parameters, mask=contains)
string_from_object = FromObject(obj=filterByBoolMask.in)
flatten_2 = List.Flatten(list=string_from_object)
code_block_8 = CodeBlock { " : "; }
split_2 = String.Split(str=flatten_2, separater0=code_block_8)
code_block_9 = CodeBlock { 1; }
getItemAtIndex_4 = List.GetItemAtIndex(list=split_2@L2, index=code_block_9)
model_group_workset = Watch(getItemAtIndex_4)

groupByKey_2 = List.GroupByKey(list=all_elements_of_category_4, keys=getParameterValueByName_2)
count_2 = List.Count(list=groupByKey_2.groups@L2)

# group (continued): Model Groups
model_group_id = Watch(count_2)

firstItem = List.FirstItem(list=groupByKey_2.groups@L2)

# group: Detail Groups
python_get_detail_groups = Python()  # graph input
# ---------- python_get_detail_groups.python (35 lines) ----------
#Copyright(c) 2015, Konrad Sobon
# @arch_laboratory, http://archi-lab.net

import clr
clr.AddReference('ProtoGeometry')
from Autodesk.DesignScript.Geometry import *

# Import DocumentManager and TransactionManager
clr.AddReference("RevitServices")
import RevitServices
from RevitServices.Persistence import DocumentManager
from RevitServices.Transactions import TransactionManager

# Import RevitAPI
clr.AddReference("RevitAPI")
import Autodesk
from Autodesk.Revit.DB import *

doc = DocumentManager.Instance.CurrentDBDocument
uiapp = DocumentManager.Instance.CurrentUIApplication
app = uiapp.Application

from System.Collections.Generic import *

#The inputs to this node will be stored as a list in the IN variable.
dataEnteringNode = IN

collector = FilteredElementCollector(doc)
groups = collector.OfCategory(BuiltInCategory.OST_IOSDetailGroups).WhereElementIsNotElementType().ToElements()

groupNames = []
for i in groups:
	groupNames.append(i.Name)

OUT = groupNames, groups
# ----------------------------------------
code_block_10 = CodeBlock(OUT=python_get_detail_groups) { OUT[0]; OUT[1]; }
code_block_11 = CodeBlock { "Type Id"; }
getParameterValueByName_3 = Element.GetParameterValueByName(element=code_block_10.out1, parameterName=code_block_11)
id_2 = Element.Id(element=getParameterValueByName_3)
groupByKey_3 = List.GroupByKey(list=code_block_10.out0, keys=id_2)
firstItem_2 = List.FirstItem(list=groupByKey_3.groups@L2)
groupByKey_4 = List.GroupByKey(list=code_block_10.out1, keys=id_2)
firstItem_3 = List.FirstItem(list=groupByKey_4.groups@L2)
count_3 = List.Count(list=groupByKey_4.groups@L2)
detail_group_name = Watch(code_block_10.out0)
python_get_unused_detail_groups = Python()  # graph input
# ---------- python_get_unused_detail_groups.python (32 lines) ----------
#Copyright(c) 2015, Konrad Sobon
# @arch_laboratory, http://archi-lab.net

import clr
clr.AddReference('ProtoGeometry')
from Autodesk.DesignScript.Geometry import *

# Import DocumentManager and TransactionManager
clr.AddReference("RevitServices")
import RevitServices
from RevitServices.Persistence import DocumentManager
from RevitServices.Transactions import TransactionManager

# Import RevitAPI
clr.AddReference("RevitAPI")
import Autodesk
from Autodesk.Revit.DB import *

doc = DocumentManager.Instance.CurrentDBDocument
uiapp = DocumentManager.Instance.CurrentUIApplication
app = uiapp.Application

#The inputs to this node will be stored as a list in the IN variable.
dataEnteringNode = IN

groups = FilteredElementCollector(doc).OfClass(GroupType)
unplacedGroups = []
for i in groups:
	gInstances = i.Groups
	if gInstances.IsEmpty == 1:
		unplacedGroups.append(i)
OUT = unplacedGroups
# ----------------------------------------
name_7 = Element.Name(element=python_get_unused_detail_groups)
unused_detail_groups = Watch(name_7)
parameters_2 = Element.Parameters(element=code_block_10.out1)
name_8 = Parameter.Name(parameter=parameters_2)
code_block_12 = CodeBlock { "Workset"; }
contains_2 = String.Contains(str=name_8@L2, searchFor=code_block_12)
filterByBoolMask_2 = List.FilterByBoolMask(list=parameters_2, mask=contains_2)
string_from_object_2 = FromObject(obj=filterByBoolMask_2.in)
flatten_3 = List.Flatten(list=string_from_object_2)
code_block_13 = CodeBlock { " : "; }
split_3 = String.Split(str=flatten_3, separater0=code_block_13)
code_block_14 = CodeBlock { 1; }
getItemAtIndex_5 = List.GetItemAtIndex(list=split_3@L2, index=code_block_14)
detail_group_workset = Watch(getItemAtIndex_5)

detail_group_count = Watch(count_3)

# group: placed Views
categories_5 = Categories(index=602)
all_elements_of_category_5 = ElementsOfCategory(Category=categories_5)
code_block_15 = CodeBlock { "Sheet Number"; }
getParameterValueByName_4 = Element.GetParameterValueByName(element=all_elements_of_category_5, parameterName=code_block_15)
code_block_16 = CodeBlock { ""; }
eq = code_block_16 == getParameterValueByName_4
code_block_17 = CodeBlock { "1:"; "Scale Value    1:"; }
code_block_18 = CodeBlock { " "; }

code_block_19 = CodeBlock { "---"; }
eq_2 = code_block_19 == getParameterValueByName_4
or_ = eq_2 || eq

# group (continued): placed Views
filterByBoolMask_3 = List.FilterByBoolMask(list=all_elements_of_category_5, mask=or_)
type = archilab.Revit.Elements.Elements.Type(element=filterByBoolMask_3.out)
name_9 = FamilyType.Name(familyType=type)

# group: Warning Counts
getWarnings = archilab.Revit.Elements.Warning.GetWarnings()
errorMessage = archilab.Revit.Elements.Warning.ErrorMessage(warning=getWarnings)
groupByKey_5 = List.GroupByKey(list=getWarnings, keys=errorMessage)
groupByKey_6 = List.GroupByKey(list=errorMessage, keys=errorMessage)
count_4 = List.Count(list=groupByKey_6.groups@L2)
sortByKey = List.SortByKey(list=groupByKey_5.groups, keys=count_4)
reverse = List.Reverse(list=sortByKey.sorted_list)
code_block_20 = CodeBlock { "("; ") "; }
sortByKey_2 = List.SortByKey(list=groupByKey_6.groups, keys=count_4)
reverse_2 = List.Reverse(list=sortByKey_2.sorted_keys)
watch = Watch(reverse_2)
add_2 = code_block_20.out0 + watch
add_3 = add_2 + code_block_20.out1
firstItem_4 = List.FirstItem(list=sortByKey_2.sorted_list@L2)
reverse_3 = List.Reverse(list=firstItem_4)
watch_2 = Watch(reverse_3)
add_4 = add_3 + watch_2
watch_3 = Watch(add_4)
list_create_3 = List.Create()  # unwired: item0
map_2 = List.Map(list=watch_2, f_x=list_create_3)
elements = archilab.Revit.Elements.Warning.Elements(warning=getWarnings)
id_3 = archilab.Revit.Elements.WarningElement.Id(warningElement=elements)
watch_4 = Watch(id_3)

code_block_21 = CodeBlock { Angle (degr.); }
code_block_22 = CodeBlock { 0; }
getItemAtIndex_6 = List.GetItemAtIndex(list=python_script@L3, index=code_block_22)
code_block_23 = CodeBlock(seq=getItemAtIndex_6) { seq[0][2]; }
code_block_24 = CodeBlock { true; null; }
python_script_2 = Python()  # unwired: IN[0]
# ---------- python_script_2.python (12 lines) ----------
import clr
clr.AddReference("RevitServices")
import RevitServices
from RevitServices.Persistence import DocumentManager

doc = DocumentManager.Instance.CurrentDBDocument
uiapp = DocumentManager.Instance.CurrentUIApplication
app = uiapp.Application
if int(app.VersionNumber) > 2017: fullVersion = app.SubVersionNumber
else: fullVersion = str(app.VersionNumber)

OUT = app.VersionName, int(app.VersionNumber), app.VersionBuild, app.Language.ToString(), fullVersion
# ----------------------------------------
code_block_25 = CodeBlock(seq=python_script_2) { seq[1]; }
python_script_3 = Python(IN[0]=code_block_23, IN[1]=code_block_24.out1, IN[2]=code_block_25)
# ---------- python_script_3.python (27 lines) ----------
import clr
clr.AddReference('RevitAPI')
from Autodesk.Revit.DB import *
import Autodesk

clr.AddReference("RevitServices")
import RevitServices
from RevitServices.Persistence import DocumentManager

inputdoc = UnwrapElement(IN[1])
version = IN[2]
if inputdoc == None:
	doc = DocumentManager.Instance.CurrentDBDocument
elif inputdoc.GetType().ToString() == "Autodesk.Revit.DB.RevitLinkInstance":
	doc = inputdoc.GetLinkDocument()
elif inputdoc.GetType().ToString() == "Autodesk.Revit.DB.Document":
	doc = inputdoc
else: doc = None

projloc = doc.ActiveProjectLocation
if version > 2017:
	position_data = projloc.GetProjectPosition(XYZ.Zero)
	location_data = projloc.GetSiteLocation()
else:
	position_data = projloc.ProjectPosition[XYZ.Zero]
	location_data = projloc.SiteLocation
OUT = (position_data.Angle,position_data.Elevation,position_data.EastWest,position_data.NorthSouth)
# ----------------------------------------
code_block_26 = CodeBlock(seq=python_script_3) { seq[0]; seq[1]; seq[2]; seq[3]; }
unit_types = UnitTypes(index=2)  # graph input
displayUnitType = Custom[UnitType.DisplayUnitType](unitType=unit_types)  # Retrieves the display unit type for a given unit type.
toDisplayUnit = Custom[InternalUnit.ToDisplayUnit](val=code_block_26.out1, displayUnitType=displayUnitType.displayUnitType)  # Converts a value from Revit's internal unit to a given display unit
code_block_27 = CodeBlock(Elevation=toDisplayUnit) { Elevation; }
toDisplayUnit_2 = Custom[InternalUnit.ToDisplayUnit](val=code_block_26.out2, displayUnitType=displayUnitType.displayUnitType)
code_block_28 = CodeBlock(EastWest=toDisplayUnit_2) { EastWest; }
toDisplayUnit_3 = Custom[InternalUnit.ToDisplayUnit](val=code_block_26.out3, displayUnitType=displayUnitType.displayUnitType)
code_block_29 = CodeBlock(NorthSouth=toDisplayUnit_3) { NorthSouth; }
radiansToDegrees = Math.RadiansToDegrees(radians=code_block_26.out0)
file_path = Filename("C:\Users\dennis.goff\Desktop\Test Output Current_Kingsway.xlsx")  # graph input
boolean_2 = BoolSelector(true)
boolean_3 = BoolSelector(true)
string = StringInput("Warnings")  # graph input
name_for_numbering_column = CodeBlock { "Index"; }
count_5 = List.Count(list=errorMessage)
sequence = Sequence(amount=count_5)
addItemToFront = List.AddItemToFront(item=name_for_numbering_column, list=sequence)
list_create_4 = List.Create(item0=addItemToFront)
code_block_30 = CodeBlock { "TIME OF EXPORT"; }
code_block_31 = CodeBlock { 1; 0; }
chop = List.Chop(list=sequence, lengths=code_block_31.out0)
now = DateTime.Now()
replaceItemAtIndex = List.ReplaceItemAtIndex(list=chop, index=code_block_31.out1, item=now, lacing=Longest)
flatten_4 = List.Flatten(list=replaceItemAtIndex)
addItemToFront_2 = List.AddItemToFront(item=code_block_30, list=flatten_4)
list_create_5 = List.Create(item0=addItemToFront_2)
code_block_32 = CodeBlock { "Warning"; }
addItemToFront_3 = List.AddItemToFront(item=code_block_32, list=errorMessage)
code_block_33 = CodeBlock { "Warning Element"; }
transpose_2 = List.Transpose(lists=watch_4)
string_2 = StringInput("")
replaceNulls = Lists.Manage.ReplaceNulls(Data=transpose_2, ReplaceWith=string_2)
addItemToFront_4 = List.AddItemToFront(item=code_block_33, list=replaceNulls, lacing=Longest)
python_script_4 = Python(IN[0]=addItemToFront_3, IN[1]=addItemToFront_4)
# ---------- python_script_4.python (17 lines) ----------
# Enable Python support and load DesignScript library
import clr
clr.AddReference('ProtoGeometry')
from Autodesk.DesignScript.Geometry import *

# The inputs to this node will be stored as a list in the IN variables.
dataEnteringNode = IN

regL = IN[0]
nestL = IN[1]
outL = []
# Place your code below this line
outL.append(regL)
for l in nestL:
	outL.append(l)
# Assign your output to the OUT variable.
OUT = outL
# ----------------------------------------
join = List.Join(list0=list_create_4, list1=list_create_5, list2=python_script_4)
code_block_34 = CodeBlock { 0; }
removeItemAtIndex = List.RemoveItemAtIndex(list=join, indices=code_block_34, lacing=Longest)
writeOrAppendExcel_v2 = Custom[WriteOrAppendExcel_v2](filepath=file_path, sheetName=string, baseData=join, newData=removeItemAtIndex)  # Writes or Appends data to excel sheet
string_3 = StringInput("Placed Views")  # graph input
type_2 = Custom[View.Type](view=filterByBoolMask_3.out)  # Returns the type of a given view

# group (continued): placed Views
isNull = Object.IsNull(obj=type_2)
filterByBoolMask_4 = List.FilterByBoolMask(list=filterByBoolMask_3.out, mask=isNull)
filterByBoolMask_5 = List.FilterByBoolMask(list=type_2, mask=isNull)
groupByKey_7 = List.GroupByKey(list=filterByBoolMask_4.out, keys=filterByBoolMask_5.out)
name_10 = Element.Name(element=groupByKey_7.groups)
flatten_5 = List.Flatten(list=name_10)
view_names = Watch(flatten_5)
groupByKey_8 = List.GroupByKey(list=filterByBoolMask_5.out, keys=filterByBoolMask_5.out)
flatten_6 = List.Flatten(list=groupByKey_8.groups)
type_3 = Watch(flatten_6)
getParameterValueByName_5 = Element.GetParameterValueByName(element=groupByKey_7.groups, parameterName=code_block_17.out1)
flatten_7 = List.Flatten(list=getParameterValueByName_5)
view_scale = Watch(flatten_7)
getParameterValueByName_6 = Element.GetParameterValueByName(element=groupByKey_7.groups, parameterName=code_block_15)
flatten_8 = List.Flatten(list=getParameterValueByName_6)
sheet = Watch(flatten_8)

count_6 = List.Count(list=view_names)
sequence_2 = Sequence(amount=count_6)
addItemToFront_5 = List.AddItemToFront(item=name_for_numbering_column, list=sequence_2)
chop_2 = List.Chop(list=sequence_2, lengths=code_block_31.out0)
replaceItemAtIndex_2 = List.ReplaceItemAtIndex(list=chop_2, index=code_block_31.out1, item=now, lacing=Longest)
flatten_9 = List.Flatten(list=replaceItemAtIndex_2)
addItemToFront_6 = List.AddItemToFront(item=code_block_30, list=flatten_9)
code_block_35 = CodeBlock { "View Names"; }
addItemToFront_7 = List.AddItemToFront(item=code_block_35, list=view_names)
code_block_36 = CodeBlock { "Type"; }
addItemToFront_8 = List.AddItemToFront(item=code_block_36, list=type_3)
code_block_37 = CodeBlock { "View Scale"; }
addItemToFront_9 = List.AddItemToFront(item=code_block_37, list=view_scale)
code_block_38 = CodeBlock { "Sheet"; }
addItemToFront_10 = List.AddItemToFront(item=code_block_38, list=sheet)
code_block_39 = CodeBlock { "View Template"; }
viewTemplate = archilab.Revit.Views.Views.ViewTemplate(view=groupByKey_7.groups)
name_11 = Element.Name(element=viewTemplate)
replaceNulls_2 = Lists.Manage.ReplaceNulls(Data=name_11, ReplaceWith=code_block_18)
flatten_10 = List.Flatten(list=replaceNulls_2)
sheet_2 = Watch(flatten_10)
addItemToFront_11 = List.AddItemToFront(item=code_block_39, list=sheet_2)
code_block_40 = CodeBlock { "Creator"; }
python_script_5 = Python(IN[0]=filterByBoolMask_4.out)
# ---------- python_script_5.python (27 lines) ----------
import clr
clr.AddReference('RevitServices')
import RevitServices
from RevitServices.Persistence import DocumentManager
from RevitServices.Transactions import TransactionManager

# Import RevitAPI
clr.AddReference('RevitAPI')
import Autodesk
# Import Revit Nodes ¿?
clr.AddReference("RevitNodes")
import Revit
# Import from Revit DB
from Autodesk.Revit.DB import *
doc = DocumentManager.Instance.CurrentDBDocument
#The inputs to this node will be stored as a list in the IN variables.
dataEnteringNode = IN

input = UnwrapElement(IN[0])
creator = []
lastChange = []
for i in input:
	creator.Add( WorksharingUtils.GetWorksharingTooltipInfo(doc, i.Id).Creator)
	lastChange.Add(WorksharingUtils.GetWorksharingTooltipInfo(doc, i.Id).LastChangedBy)
	
#Assign your output to the OUT variable.
OUT = creator, lastChange
# ----------------------------------------
firstItem_5 = List.FirstItem(list=python_script_5)
groupByKey_9 = List.GroupByKey(list=firstItem_5, keys=filterByBoolMask_5.out)

# group (continued): placed Views
flatten_11 = List.Flatten(list=groupByKey_9.groups)
sheet_3 = Watch(flatten_11)

addItemToFront_12 = List.AddItemToFront(item=code_block_40, list=sheet_3)
code_block_41 = CodeBlock { "User Name"; }
code_block_42 = CodeBlock { "User Name"; }
getParameterValueByName_7 = Element.GetParameterValueByName(element=groupByKey_7.groups, parameterName=code_block_42)

# group (continued): placed Views
flatten_12 = List.Flatten(list=getParameterValueByName_7)
sheet_4 = Watch(flatten_12)

addItemToFront_13 = List.AddItemToFront(item=code_block_41, list=sheet_4)
code_block_43 = CodeBlock { "Placed"; }
code_block_44 = CodeBlock { "PLACED"; }
replaceItemAtIndex_3 = List.ReplaceItemAtIndex(list=chop_2, index=code_block_31.out1, item=code_block_44, lacing=Longest)
flatten_13 = List.Flatten(list=replaceItemAtIndex_3)
addItemToFront_14 = List.AddItemToFront(item=code_block_43, list=flatten_13)
list_create_6 = List.Create(item0=addItemToFront_5, item1=addItemToFront_6, item2=addItemToFront_7, item3=addItemToFront_8, item4=addItemToFront_9, item5=addItemToFront_10, item6=addItemToFront_11, item7=addItemToFront_12, item8=addItemToFront_13, item9=addItemToFront_14)
removeItemAtIndex_2 = List.RemoveItemAtIndex(list=list_create_6, indices=code_block_34, lacing=Longest)
writeOrAppendExcel_v2_2 = Custom[WriteOrAppendExcel_v2](filepath=file_path, sheetName=string_3, baseData=list_create_6, newData=removeItemAtIndex_2)
string_4 = StringInput("Unplaced Views")  # graph input
type_4 = Custom[View.Type](view=filterByBoolMask_3.in)

# group: Unplaced Views
type_5 = archilab.Revit.Elements.Elements.Type(element=filterByBoolMask_3.in)
name_12 = FamilyType.Name(familyType=type_5)
isNull_2 = Object.IsNull(obj=type_4)
filterByBoolMask_6 = List.FilterByBoolMask(list=filterByBoolMask_3.in, mask=isNull_2)
filterByBoolMask_7 = List.FilterByBoolMask(list=type_4, mask=isNull_2)
groupByKey_10 = List.GroupByKey(list=filterByBoolMask_6.out, keys=filterByBoolMask_7.out)
name_13 = Element.Name(element=groupByKey_10.groups)
flatten_14 = List.Flatten(list=name_13)
view_names_2 = Watch(flatten_14)
groupByKey_11 = List.GroupByKey(list=filterByBoolMask_7.out, keys=filterByBoolMask_7.out)
flatten_15 = List.Flatten(list=groupByKey_11.groups)
type_6 = Watch(flatten_15)
code_block_45 = CodeBlock { "1:"; "Scale Value    1:"; }
getParameterValueByName_8 = Element.GetParameterValueByName(element=groupByKey_10.groups, parameterName=code_block_45.out1)
flatten_16 = List.Flatten(list=getParameterValueByName_8)
view_scale_2 = Watch(flatten_16)
code_block_46 = CodeBlock { " "; }

count_7 = List.Count(list=view_names_2)
sequence_3 = Sequence(amount=count_7)
addItemToFront_15 = List.AddItemToFront(item=name_for_numbering_column, list=sequence_3)
chop_3 = List.Chop(list=sequence_3, lengths=code_block_31.out0)
replaceItemAtIndex_4 = List.ReplaceItemAtIndex(list=chop_3, index=code_block_31.out1, item=now, lacing=Longest)
flatten_17 = List.Flatten(list=replaceItemAtIndex_4)
addItemToFront_16 = List.AddItemToFront(item=code_block_30, list=flatten_17)
code_block_47 = CodeBlock { "View Names"; }
addItemToFront_17 = List.AddItemToFront(item=code_block_47, list=view_names_2)
code_block_48 = CodeBlock { "Type"; }
addItemToFront_18 = List.AddItemToFront(item=code_block_48, list=type_6)
code_block_49 = CodeBlock { "View Scale"; }
addItemToFront_19 = List.AddItemToFront(item=code_block_49, list=view_scale_2)
code_block_50 = CodeBlock { "UNPLACED"; }
replaceItemAtIndex_5 = List.ReplaceItemAtIndex(list=chop_3, index=code_block_31.out1, item=code_block_50, lacing=Longest)
flatten_18 = List.Flatten(list=replaceItemAtIndex_5)
addItemToFront_20 = List.AddItemToFront(item=code_block_38, list=flatten_18)
code_block_51 = CodeBlock { "Template"; }
viewTemplate_2 = archilab.Revit.Views.Views.ViewTemplate(view=groupByKey_10.groups)
name_14 = Element.Name(element=viewTemplate_2)
replaceNulls_3 = Lists.Manage.ReplaceNulls(Data=name_14, ReplaceWith=code_block_46)
flatten_19 = List.Flatten(list=replaceNulls_3)
sheet_5 = Watch(flatten_19)
addItemToFront_21 = List.AddItemToFront(item=code_block_51, list=sheet_5)
code_block_52 = CodeBlock { "Creator"; }
python_script_6 = Python(IN[0]=filterByBoolMask_6.out)  # same code as python_script_5
firstItem_6 = List.FirstItem(list=python_script_6)
groupByKey_12 = List.GroupByKey(list=firstItem_6, keys=filterByBoolMask_7.out)

# group (continued): Unplaced Views
flatten_20 = List.Flatten(list=groupByKey_12.groups)
sheet_6 = Watch(flatten_20)

addItemToFront_22 = List.AddItemToFront(item=code_block_52, list=sheet_6)
code_block_53 = CodeBlock { "User Name"; }
code_block_54 = CodeBlock { "User Name"; }
getParameterValueByName_9 = Element.GetParameterValueByName(element=groupByKey_10.groups, parameterName=code_block_54)

# group (continued): Unplaced Views
flatten_21 = List.Flatten(list=getParameterValueByName_9)
sheet_7 = Watch(flatten_21)

addItemToFront_23 = List.AddItemToFront(item=code_block_53, list=sheet_7)
replaceItemAtIndex_6 = List.ReplaceItemAtIndex(list=chop_3, index=code_block_31.out1, item=code_block_50, lacing=Longest)
flatten_22 = List.Flatten(list=replaceItemAtIndex_6)
addItemToFront_24 = List.AddItemToFront(item=code_block_43, list=flatten_22)
list_create_7 = List.Create(item0=addItemToFront_15, item1=addItemToFront_16, item2=addItemToFront_17, item3=addItemToFront_18, item4=addItemToFront_19, item5=addItemToFront_20, item6=addItemToFront_21, item7=addItemToFront_22, item8=addItemToFront_23, item9=addItemToFront_24)
removeItemAtIndex_3 = List.RemoveItemAtIndex(list=list_create_7, indices=code_block_34, lacing=Longest)
writeOrAppendExcel_v2_3 = Custom[WriteOrAppendExcel_v2](filepath=file_path, sheetName=string_4, baseData=list_create_7, newData=removeItemAtIndex_3)
string_5 = StringInput("View Template")  # graph input

# group: View Templates
view_type = ViewTypesUi(index=23)
getByType = archilab.Revit.Views.Views.GetByType(viewType=view_type)
categories_6 = Categories(index=602)
all_elements_of_category_6 = ElementsOfCategory(Category=categories_6)
viewTemplate_3 = archilab.Revit.Views.Views.ViewTemplate(view=all_elements_of_category_6)
id_4 = Element.Id(element=viewTemplate_3)
groupByKey_13 = List.GroupByKey(list=viewTemplate_3, keys=id_4)
list_create_8 = List.Create()  # unwired: item0
map_3 = List.Map(list=groupByKey_13.unique_keys, f_x=list_create_8)
id_5 = Element.Id(element=getByType)
eq_3 = map_3@L2 == id_5  # lacing=CrossProduct
flatten_23 = List.Flatten(list=eq_3@L3)
transpose_3 = List.Transpose(lists=flatten_23)
allFalse = List.AllFalse(list=transpose_3@L2)
filterByBoolMask_8 = List.FilterByBoolMask(list=getByType, mask=allFalse)
unused_view_template = Watch(filterByBoolMask_8.in)
used_view_template = Watch(filterByBoolMask_8.out)

count_8 = List.Count(list=unused_view_template)
sequence_4 = Sequence(amount=count_8)
addItemToFront_25 = List.AddItemToFront(item=name_for_numbering_column, list=sequence_4)
chop_4 = List.Chop(list=sequence_4, lengths=code_block_31.out0)
replaceItemAtIndex_7 = List.ReplaceItemAtIndex(list=chop_4, index=code_block_31.out1, item=now, lacing=Longest)
flatten_24 = List.Flatten(list=replaceItemAtIndex_7)
addItemToFront_26 = List.AddItemToFront(item=code_block_30, list=flatten_24)
code_block_55 = CodeBlock { "Unused Template"; }
string_from_object_3 = FromObject(obj=unused_view_template)
addItemToFront_27 = List.AddItemToFront(item=code_block_55, list=string_from_object_3)
code_block_56 = CodeBlock { "Used Template"; }
string_from_object_4 = FromObject(obj=used_view_template)
addItemToFront_28 = List.AddItemToFront(item=code_block_56, list=string_from_object_4)
list_create_9 = List.Create(item0=addItemToFront_25, item1=addItemToFront_26, item2=addItemToFront_27, item3=addItemToFront_28)
removeItemAtIndex_4 = List.RemoveItemAtIndex(list=list_create_9, indices=code_block_34, lacing=Longest)
writeOrAppendExcel_v2_4 = Custom[WriteOrAppendExcel_v2](filepath=file_path, sheetName=string_5, baseData=list_create_9, newData=removeItemAtIndex_4)
string_6 = StringInput("Filters")  # graph input

# group: Filters
element_types = ElementTypes(index=127)
all_elements_of_type = ElementsOfType(element_type=element_types)
name_15 = Element.Name(element=all_elements_of_type)
categories_7 = Categories(index=602)
all_elements_of_category_7 = ElementsOfCategory(Category=categories_7)
filters = View.Filters(view=all_elements_of_category_7)
id_6 = Element.Id(element=filters)
flatten_25 = List.Flatten(list=id_6)
uniqueItems = List.UniqueItems(list=flatten_25)
list_create_10 = List.Create()  # unwired: item0
map_4 = List.Map(list=uniqueItems, f_x=list_create_10)
id_7 = Element.Id(element=all_elements_of_type)
eq_4 = map_4@L2 == id_7  # lacing=CrossProduct
flatten_26 = List.Flatten(list=eq_4@L3)
transpose_4 = List.Transpose(lists=flatten_26)
allFalse_2 = List.AllFalse(list=transpose_4@L2)
filterByBoolMask_9 = List.FilterByBoolMask(list=name_15, mask=allFalse_2)
unused_filters = Watch(filterByBoolMask_9.in)
used_filter = Watch(filterByBoolMask_9.out)

code_block_57 = CodeBlock { 1; 0; }
chop_5 = List.Chop(list=unused_filters, lengths=code_block_57.out0)
boolean_4 = BoolSelector(false)
replaceItemAtIndex_8 = List.ReplaceItemAtIndex(list=chop_5, index=code_block_57.out1, item=boolean_4)
flatten_27 = List.Flatten(list=replaceItemAtIndex_8)
chop_6 = List.Chop(list=used_filter, lengths=code_block_57.out0)
boolean_5 = BoolSelector(true)
replaceItemAtIndex_9 = List.ReplaceItemAtIndex(list=chop_6, index=code_block_57.out1, item=boolean_5)
flatten_28 = List.Flatten(list=replaceItemAtIndex_9)
join_2 = List.Join(list0=flatten_27, list1=flatten_28)
count_9 = List.Count(list=join_2)
sequence_5 = Sequence(amount=count_9)
addItemToFront_29 = List.AddItemToFront(item=name_for_numbering_column, list=sequence_5)
chop_7 = List.Chop(list=sequence_5, lengths=code_block_31.out0)
replaceItemAtIndex_10 = List.ReplaceItemAtIndex(list=chop_7, index=code_block_31.out1, item=now, lacing=Longest)
flatten_29 = List.Flatten(list=replaceItemAtIndex_10)
addItemToFront_30 = List.AddItemToFront(item=code_block_30, list=flatten_29)
code_block_58 = CodeBlock { "Filter"; }
join_3 = List.Join(list0=unused_filters, list1=used_filter)
addItemToFront_31 = List.AddItemToFront(item=code_block_58, list=join_3)
code_block_59 = CodeBlock { "Used"; }
addItemToFront_32 = List.AddItemToFront(item=code_block_59, list=join_3)
list_create_11 = List.Create(item0=addItemToFront_29, item1=addItemToFront_30, item2=addItemToFront_31, item3=addItemToFront_32)
removeItemAtIndex_5 = List.RemoveItemAtIndex(list=list_create_11, indices=code_block_34, lacing=Longest)
writeOrAppendExcel_v2_5 = Custom[WriteOrAppendExcel_v2](filepath=file_path, sheetName=string_6, baseData=list_create_11, newData=removeItemAtIndex_5)
string_7 = StringInput("Legends")  # graph input
count_10 = List.Count(list=legend_names)
sequence_6 = Sequence(amount=count_10)
addItemToFront_33 = List.AddItemToFront(item=name_for_numbering_column, list=sequence_6)
chop_8 = List.Chop(list=sequence_6, lengths=code_block_31.out0)
replaceItemAtIndex_11 = List.ReplaceItemAtIndex(list=chop_8, index=code_block_31.out1, item=now, lacing=Longest)
flatten_30 = List.Flatten(list=replaceItemAtIndex_11)
addItemToFront_34 = List.AddItemToFront(item=code_block_30, list=flatten_30)
code_block_60 = CodeBlock { "Legend Names"; }
addItemToFront_35 = List.AddItemToFront(item=code_block_60, list=legend_names)
code_block_61 = CodeBlock { "Legend Scale"; }
addItemToFront_36 = List.AddItemToFront(item=code_block_61, list=legend_scale)
list_create_12 = List.Create(item0=addItemToFront_33, item1=addItemToFront_34, item2=addItemToFront_35, item3=addItemToFront_36)
removeItemAtIndex_6 = List.RemoveItemAtIndex(list=list_create_12, indices=code_block_34, lacing=Longest)
writeOrAppendExcel_v2_6 = Custom[WriteOrAppendExcel_v2](filepath=file_path, sheetName=string_7, baseData=list_create_12, newData=removeItemAtIndex_6)
string_8 = StringInput("Schedules")  # graph input

# group: Schedules
categories_8 = Categories(index=432)
all_elements_of_category_8 = ElementsOfCategory(Category=categories_8)
name_16 = Element.Name(element=all_elements_of_category_8)
schedule_names = Watch(name_16)

count_11 = List.Count(list=schedule_names)
sequence_7 = Sequence(amount=count_11)
addItemToFront_37 = List.AddItemToFront(item=name_for_numbering_column, list=sequence_7)
chop_9 = List.Chop(list=sequence_7, lengths=code_block_31.out0)
replaceItemAtIndex_12 = List.ReplaceItemAtIndex(list=chop_9, index=code_block_31.out1, item=now, lacing=Longest)
flatten_31 = List.Flatten(list=replaceItemAtIndex_12)
addItemToFront_38 = List.AddItemToFront(item=code_block_30, list=flatten_31)
code_block_62 = CodeBlock { "Schedule Names"; }
addItemToFront_39 = List.AddItemToFront(item=code_block_62, list=schedule_names)
list_create_13 = List.Create(item0=addItemToFront_37, item1=addItemToFront_38, item2=addItemToFront_39)
removeItemAtIndex_7 = List.RemoveItemAtIndex(list=list_create_13, indices=code_block_34, lacing=Longest)
writeOrAppendExcel_v2_7 = Custom[WriteOrAppendExcel_v2](filepath=file_path, sheetName=string_8, baseData=list_create_13, newData=removeItemAtIndex_7)
string_9 = StringInput("Sheets")  # graph input

# group: Sheets
categories_9 = Categories(index=447)
all_elements_of_category_9 = ElementsOfCategory(Category=categories_9)
code_block_63 = CodeBlock { "Sheet Number"; }
code_block_64 = CodeBlock { "Scale"; }
code_block_65 = CodeBlock { "Discipline Name"; }
code_block_66 = CodeBlock { "Appears In Sheet List"; }
code_block_67 = CodeBlock { "Sheet Issue Date"; }

flatten_32 = List.Flatten(list=all_elements_of_category_9)

# group (continued): Sheets
name_17 = Element.Name(element=flatten_32)
sheet_names = Watch(name_17)
getParameterValueByName_10 = Element.GetParameterValueByName(element=flatten_32, parameterName=code_block_63)
sheet_parameter = Watch(getParameterValueByName_10)
getParameterValueByName_11 = Element.GetParameterValueByName(element=flatten_32, parameterName=code_block_64)
sheet_parameter_2 = Watch(getParameterValueByName_11)
getParameterValueByName_12 = Element.GetParameterValueByName(element=flatten_32, parameterName=code_block_65)
sheet_parameter_3 = Watch(getParameterValueByName_12)
getParameterValueByName_13 = Element.GetParameterValueByName(element=flatten_32, parameterName=code_block_66)
sheet_parameter_4 = Watch(getParameterValueByName_13)
getParameterValueByName_14 = Element.GetParameterValueByName(element=flatten_32, parameterName=code_block_67)
sheet_parameter_5 = Watch(getParameterValueByName_14)

count_12 = List.Count(list=sheet_names)
sequence_8 = Sequence(amount=count_12)
addItemToFront_40 = List.AddItemToFront(item=name_for_numbering_column, list=sequence_8)
chop_10 = List.Chop(list=sequence_8, lengths=code_block_31.out0)
replaceItemAtIndex_13 = List.ReplaceItemAtIndex(list=chop_10, index=code_block_31.out1, item=now, lacing=Longest)
flatten_33 = List.Flatten(list=replaceItemAtIndex_13)
addItemToFront_41 = List.AddItemToFront(item=code_block_30, list=flatten_33)
code_block_68 = CodeBlock { "Sheet Names"; }
addItemToFront_42 = List.AddItemToFront(item=code_block_68, list=sheet_names)
addItemToFront_43 = List.AddItemToFront(item=code_block_63, list=sheet_parameter)
addItemToFront_44 = List.AddItemToFront(item=code_block_64, list=sheet_parameter_2)
addItemToFront_45 = List.AddItemToFront(item=code_block_65, list=sheet_parameter_3)
addItemToFront_46 = List.AddItemToFront(item=code_block_66, list=sheet_parameter_4)
addItemToFront_47 = List.AddItemToFront(item=code_block_67, list=sheet_parameter_5)
code_block_69 = CodeBlock { "Revisions on Sheet"; }
revisions = archilab.Revit.Views.Sheets.Revisions(sheet=flatten_32)
name_18 = Element.Name(element=revisions)
string_from_array = FromArray(arr=name_18)
code_block_70 = CodeBlock { "{"; }
split_4 = String.Split(str=string_from_array, separater0=code_block_70)
code_block_71 = CodeBlock { 0; }
length = String.Length(str=split_4)
code_block_72 = CodeBlock(x=length) { x-2; }
substring = String.Substring(str=split_4, startIndex=code_block_71, length=code_block_72)

# group (continued): Sheets
sheet_parameter_6 = Watch(substring)

addItemToFront_48 = List.AddItemToFront(item=code_block_69, list=sheet_parameter_6)
list_create_14 = List.Create(item0=addItemToFront_40, item1=addItemToFront_41, item2=addItemToFront_42, item3=addItemToFront_43, item4=addItemToFront_44, item5=addItemToFront_45, item6=addItemToFront_46, item7=addItemToFront_47, item8=addItemToFront_48)
removeItemAtIndex_8 = List.RemoveItemAtIndex(list=list_create_14, indices=code_block_34, lacing=Longest)
writeOrAppendExcel_v2_8 = Custom[WriteOrAppendExcel_v2](filepath=file_path, sheetName=string_9, baseData=list_create_14, newData=removeItemAtIndex_8)
string_10 = StringInput("Model Group")  # graph input
count_13 = List.Count(list=model_group_name)
sequence_9 = Sequence(amount=count_13)
addItemToFront_49 = List.AddItemToFront(item=name_for_numbering_column, list=sequence_9)
chop_11 = List.Chop(list=sequence_9, lengths=code_block_31.out0)
replaceItemAtIndex_14 = List.ReplaceItemAtIndex(list=chop_11, index=code_block_31.out1, item=now, lacing=Longest)
flatten_34 = List.Flatten(list=replaceItemAtIndex_14)
addItemToFront_50 = List.AddItemToFront(item=code_block_30, list=flatten_34)
code_block_73 = CodeBlock { "Model Group Name"; }
addItemToFront_51 = List.AddItemToFront(item=code_block_73, list=model_group_name)
code_block_74 = CodeBlock { "Model Group Workset"; }
addItemToFront_52 = List.AddItemToFront(item=code_block_74, list=model_group_workset)
list_create_15 = List.Create(item0=addItemToFront_49, item1=addItemToFront_50, item2=addItemToFront_51, item3=addItemToFront_52)
removeItemAtIndex_9 = List.RemoveItemAtIndex(list=list_create_15, indices=code_block_34, lacing=Longest)
writeOrAppendExcel_v2_9 = Custom[WriteOrAppendExcel_v2](filepath=file_path, sheetName=string_10, baseData=list_create_15, newData=removeItemAtIndex_9)
string_11 = StringInput("Detail Group")  # graph input
join_4 = List.Join(list0=detail_group_name, list1=unused_detail_groups)
count_14 = List.Count(list=join_4)
sequence_10 = Sequence(amount=count_14)
addItemToFront_53 = List.AddItemToFront(item=name_for_numbering_column, list=sequence_10)
chop_12 = List.Chop(list=sequence_10, lengths=code_block_31.out0)
replaceItemAtIndex_15 = List.ReplaceItemAtIndex(list=chop_12, index=code_block_31.out1, item=now, lacing=Longest)
flatten_35 = List.Flatten(list=replaceItemAtIndex_15)
addItemToFront_54 = List.AddItemToFront(item=code_block_30, list=flatten_35)
code_block_75 = CodeBlock { "Detail Group Name"; }
addItemToFront_55 = List.AddItemToFront(item=code_block_75, list=join_4)
code_block_76 = CodeBlock { "Detail Group Workset"; }
code_block_77 = CodeBlock { 1; 0; }
chop_13 = List.Chop(list=unused_detail_groups, lengths=code_block_77.out0)
string_12 = StringInput("")
replaceItemAtIndex_16 = List.ReplaceItemAtIndex(list=chop_13, index=code_block_77.out1, item=string_12, lacing=Longest)
flatten_36 = List.Flatten(list=replaceItemAtIndex_16)
join_5 = List.Join(list0=detail_group_workset, list1=flatten_36)
addItemToFront_56 = List.AddItemToFront(item=code_block_76, list=join_5)
code_block_78 = CodeBlock { "Used"; }
chop_14 = List.Chop(list=detail_group_name, lengths=code_block_77.out0)
boolean_6 = BoolSelector(true)
replaceItemAtIndex_17 = List.ReplaceItemAtIndex(list=chop_14, index=code_block_77.out1, item=boolean_6, lacing=Longest)
flatten_37 = List.Flatten(list=replaceItemAtIndex_17)
boolean_7 = BoolSelector(false)
replaceItemAtIndex_18 = List.ReplaceItemAtIndex(list=chop_13, index=code_block_77.out1, item=boolean_7, lacing=Longest)
flatten_38 = List.Flatten(list=replaceItemAtIndex_18)
join_6 = List.Join(list0=flatten_37, list1=flatten_38)
addItemToFront_57 = List.AddItemToFront(item=code_block_78, list=join_6)
list_create_16 = List.Create(item0=addItemToFront_53, item1=addItemToFront_54, item2=addItemToFront_55, item3=addItemToFront_56, item4=addItemToFront_57)
code_block_79 = CodeBlock { " "; }
replaceNulls_4 = Lists.Manage.ReplaceNulls(Data=list_create_16, ReplaceWith=code_block_79)
removeItemAtIndex_10 = List.RemoveItemAtIndex(list=replaceNulls_4, indices=code_block_34, lacing=Longest)
writeOrAppendExcel_v2_10 = Custom[WriteOrAppendExcel_v2](filepath=file_path, sheetName=string_11, baseData=replaceNulls_4, newData=removeItemAtIndex_10)
string_13 = StringInput("Lines and patterns")  # graph input

# group: Line and Patterns
element_types_2 = ElementTypes(index=126)
all_elements_of_type_2 = ElementsOfType(element_type=element_types_2)
name_19 = Element.Name(element=all_elements_of_type_2)
fill_pattern_name = Watch(name_19)
element_types_3 = ElementTypes(index=174)
all_elements_of_type_3 = ElementsOfType(element_type=element_types_3)
name_20 = Element.Name(element=all_elements_of_type_3)
line_pattern_name = Watch(name_20)
categories_10 = Categories(index=256)
all_elements_of_category_10 = ElementsOfCategory(Category=categories_10)
code_block_80 = CodeBlock { "Line Style"; }
getParameterValueByName_15 = Element.GetParameterValueByName(element=all_elements_of_category_10, parameterName=code_block_80)
groupByKey_14 = List.GroupByKey(list=all_elements_of_category_10, keys=getParameterValueByName_15)
name_21 = Element.Name(element=groupByKey_14.unique_keys)
line_type = Watch(name_21)
count_15 = List.Count(list=groupByKey_14.groups@L2)
line_count = Watch(count_15)

count_16 = List.Count(list=fill_pattern_name)
sequence_11 = Sequence(amount=count_16)
addItemToFront_58 = List.AddItemToFront(item=name_for_numbering_column, list=sequence_11)
chop_15 = List.Chop(list=sequence_11, lengths=code_block_31.out0)
replaceItemAtIndex_19 = List.ReplaceItemAtIndex(list=chop_15, index=code_block_31.out1, item=now, lacing=Longest)
flatten_39 = List.Flatten(list=replaceItemAtIndex_19)
addItemToFront_59 = List.AddItemToFront(item=code_block_30, list=flatten_39)
code_block_81 = CodeBlock { "Fill Pattern Name"; }
addItemToFront_60 = List.AddItemToFront(item=code_block_81, list=fill_pattern_name)
code_block_82 = CodeBlock { "Line Pattern Name"; }
addItemToFront_61 = List.AddItemToFront(item=code_block_82, list=line_pattern_name)
code_block_83 = CodeBlock { "Line Type Name"; }
addItemToFront_62 = List.AddItemToFront(item=code_block_83, list=line_type)
code_block_84 = CodeBlock { "Line Type Count"; }
addItemToFront_63 = List.AddItemToFront(item=code_block_84, list=line_count)
list_create_17 = List.Create(item0=addItemToFront_58, item1=addItemToFront_59, item2=addItemToFront_60, item3=addItemToFront_61, item4=addItemToFront_62, item5=addItemToFront_63)
code_block_85 = CodeBlock { " "; }
replaceNulls_5 = Lists.Manage.ReplaceNulls(Data=list_create_17, ReplaceWith=code_block_85)
removeItemAtIndex_11 = List.RemoveItemAtIndex(list=replaceNulls_5, indices=code_block_34, lacing=Longest)
writeOrAppendExcel_v2_11 = Custom[WriteOrAppendExcel_v2](filepath=file_path, sheetName=string_13, baseData=replaceNulls_5, newData=removeItemAtIndex_11)
string_14 = StringInput("Revision")  # graph input

# group: Revision Clouds
categories_11 = Categories(index=404)
all_elements_of_category_11 = ElementsOfCategory(Category=categories_11)
name_22 = Element.Name(element=all_elements_of_category_11)
revision_names = Watch(name_22)
code_block_86 = CodeBlock { "Revision Number"; }
getParameterValueByName_16 = Element.GetParameterValueByName(element=all_elements_of_category_11, parameterName=code_block_86)
sheet_parameter_7 = Watch(getParameterValueByName_16)
code_block_87 = CodeBlock { "Revision Date"; }
getParameterValueByName_17 = Element.GetParameterValueByName(element=all_elements_of_category_11, parameterName=code_block_87)
sheet_parameter_8 = Watch(getParameterValueByName_17)
code_block_88 = CodeBlock { "Revision Description"; }
getParameterValueByName_18 = Element.GetParameterValueByName(element=all_elements_of_category_11, parameterName=code_block_88)
sheet_parameter_9 = Watch(getParameterValueByName_18)
code_block_89 = CodeBlock { "Issued to"; }
getParameterValueByName_19 = Element.GetParameterValueByName(element=all_elements_of_category_11, parameterName=code_block_89)
sheet_parameter_10 = Watch(getParameterValueByName_19)
code_block_90 = CodeBlock { "Issued by"; }
getParameterValueByName_20 = Element.GetParameterValueByName(element=all_elements_of_category_11, parameterName=code_block_90)
sheet_parameter_11 = Watch(getParameterValueByName_20)

count_17 = List.Count(list=revision_names)
sequence_12 = Sequence(amount=count_17)
addItemToFront_64 = List.AddItemToFront(item=name_for_numbering_column, list=sequence_12)
chop_16 = List.Chop(list=sequence_12, lengths=code_block_31.out0)
replaceItemAtIndex_20 = List.ReplaceItemAtIndex(list=chop_16, index=code_block_31.out1, item=now, lacing=Longest)
flatten_40 = List.Flatten(list=replaceItemAtIndex_20)
addItemToFront_65 = List.AddItemToFront(item=code_block_30, list=flatten_40)
code_block_91 = CodeBlock { "Revision Names"; }
addItemToFront_66 = List.AddItemToFront(item=code_block_91, list=revision_names)
addItemToFront_67 = List.AddItemToFront(item=code_block_86, list=sheet_parameter_7)
addItemToFront_68 = List.AddItemToFront(item=code_block_87, list=sheet_parameter_8)
addItemToFront_69 = List.AddItemToFront(item=code_block_88, list=sheet_parameter_9)
addItemToFront_70 = List.AddItemToFront(item=code_block_89, list=sheet_parameter_10)
addItemToFront_71 = List.AddItemToFront(item=code_block_90, list=sheet_parameter_11)
list_create_18 = List.Create(item0=addItemToFront_64, item1=addItemToFront_65, item2=addItemToFront_66, item3=addItemToFront_67, item4=addItemToFront_68, item5=addItemToFront_69, item6=addItemToFront_70, item7=addItemToFront_71)
removeItemAtIndex_12 = List.RemoveItemAtIndex(list=list_create_18, indices=code_block_34, lacing=Longest)
writeOrAppendExcel_v2_12 = Custom[WriteOrAppendExcel_v2](filepath=file_path, sheetName=string_14, baseData=list_create_18, newData=removeItemAtIndex_12)

# group: LOG EXPORT TIMES
string_15 = StringInput("EXPORT LOG")  # graph input
replaceItemAtIndex_21 = List.ReplaceItemAtIndex(list=now, index=code_block_31.out1, item=code_block_31.out1, lacing=Longest)
addItemToFront_72 = List.AddItemToFront(item=name_for_numbering_column, list=replaceItemAtIndex_21)
addItemToFront_73 = List.AddItemToFront(item=code_block_30, list=now)
list_create_19 = List.Create(item0=addItemToFront_72, item1=addItemToFront_73)
removeItemAtIndex_13 = List.RemoveItemAtIndex(list=list_create_19, indices=code_block_34, lacing=Longest)
writeOrAppendExcel_v2_13 = Custom[WriteOrAppendExcel_v2](filepath=file_path, sheetName=string_15, baseData=list_create_19, newData=removeItemAtIndex_13)

string_16 = StringInput("Materials")  # graph input

# group: Materials
categories_12 = Categories(index=296)
all_elements_of_category_12 = ElementsOfCategory(Category=categories_12)
name_23 = Element.Name(element=all_elements_of_category_12)
revision_names_2 = Watch(name_23)
code_block_92 = CodeBlock { "Description"; }
getParameterValueByName_21 = Element.GetParameterValueByName(element=all_elements_of_category_12, parameterName=code_block_92)
sheet_parameter_12 = Watch(getParameterValueByName_21)

count_18 = List.Count(list=revision_names_2)
sequence_13 = Sequence(amount=count_18)
addItemToFront_74 = List.AddItemToFront(item=name_for_numbering_column, list=sequence_13)
chop_17 = List.Chop(list=sequence_13, lengths=code_block_31.out0)
replaceItemAtIndex_22 = List.ReplaceItemAtIndex(list=chop_17, index=code_block_31.out1, item=now, lacing=Longest)
flatten_41 = List.Flatten(list=replaceItemAtIndex_22)
addItemToFront_75 = List.AddItemToFront(item=code_block_30, list=flatten_41)
code_block_93 = CodeBlock { "Material Names"; }
addItemToFront_76 = List.AddItemToFront(item=code_block_93, list=revision_names_2)
addItemToFront_77 = List.AddItemToFront(item=code_block_92, list=sheet_parameter_12)
list_create_20 = List.Create(item0=addItemToFront_74, item1=addItemToFront_75, item2=addItemToFront_76, item3=addItemToFront_77)
removeItemAtIndex_14 = List.RemoveItemAtIndex(list=list_create_20, indices=code_block_34, lacing=Longest)
writeOrAppendExcel_v2_14 = Custom[WriteOrAppendExcel_v2](filepath=file_path, sheetName=string_16, baseData=list_create_20, newData=removeItemAtIndex_14)
string_17 = StringInput("Project Parameters")  # graph input

# group: Project Parameters
boolean_8 = BoolSelector(true)
code_block_94 = CodeBlock { null; }
python_get_project_parameters = Python(IN[0]=boolean_8, IN[1]=code_block_94)
# ---------- python_get_project_parameters.python (59 lines) ----------
import clr
clr.AddReference('RevitAPI')
from Autodesk.Revit.DB import *
import Autodesk

clr.AddReference("RevitNodes")
import Revit
clr.ImportExtensions(Revit.Elements)

clr.AddReference("RevitServices")
import RevitServices
from RevitServices.Persistence import DocumentManager

inputdoc = UnwrapElement(IN[1])
if inputdoc == None:
	doc = DocumentManager.Instance.CurrentDBDocument
elif inputdoc.GetType().ToString() == "Autodesk.Revit.DB.RevitLinkInstance":
	doc = inputdoc.GetLinkDocument()
elif inputdoc.GetType().ToString() == "Autodesk.Revit.DB.Document":
	doc = inputdoc
else: doc = None

names = []
cats = []
vag = []
pgs = []
pts = []
uts = []
isvis = []
elems = []
guids = []
isinst = []
iterator = doc.ParameterBindings.ForwardIterator()
while iterator.MoveNext():
	vag.append(iterator.Key.VariesAcrossGroups)
	names.append(iterator.Key.Name)
	pgs.append(iterator.Key.ParameterGroup)
	pts.append(iterator.Key.ParameterType)
	uts.append(iterator.Key.UnitType)
	isvis.append(iterator.Key.Visible)
	elem = doc.GetElement(iterator.Key.Id)
	elems.append(elem)
	if elem.GetType().ToString() == 'Autodesk.Revit.DB.SharedParameterElement':
		guids.append(elem.GuidValue)
	else: guids.append(None)
	if iterator.Current.GetType().ToString() == 'Autodesk.Revit.DB.InstanceBinding':
		isinst.append(True)
	else:
		isinst.append(False)
	thesecats = []
	for cat in iterator.Current.Categories:
		try:
			thesecats.append(Revit.Elements.Category.ById(cat.Id.IntegerValue))
		except:
			# Return null if category is not supported by Dynamo
			# This way the user knows there are unsupported categories assigned
			thesecats.append(None)
	cats.append(thesecats)
OUT = (names,cats,vag, pgs, pts, uts, isvis, elems, guids, isinst)
# ----------------------------------------
code_block_95 = CodeBlock(seq=python_get_project_parameters) { seq[0]; seq[1]; seq[3]; seq[4]; }
watch_5 = Watch(code_block_95.out0)
watch_6 = Watch(code_block_95.out2)
watch_7 = Watch(code_block_95.out3)
code_block_96 = CodeBlock { " - "; }
string_from_object_5 = FromObject(obj=code_block_95.out1)

count_19 = List.Count(list=watch_5)
sequence_14 = Sequence(amount=count_19)
addItemToFront_78 = List.AddItemToFront(item=name_for_numbering_column, list=sequence_14)
chop_18 = List.Chop(list=sequence_14, lengths=code_block_31.out0)
replaceItemAtIndex_23 = List.ReplaceItemAtIndex(list=chop_18, index=code_block_31.out1, item=now, lacing=Longest)
flatten_42 = List.Flatten(list=replaceItemAtIndex_23)
addItemToFront_79 = List.AddItemToFront(item=code_block_30, list=flatten_42)
code_block_97 = CodeBlock { "Parameter Names"; }
addItemToFront_80 = List.AddItemToFront(item=code_block_97, list=watch_5)
code_block_98 = CodeBlock { "Parameter Type"; }
addItemToFront_81 = List.AddItemToFront(item=code_block_98, list=watch_6)
code_block_99 = CodeBlock { "Parameter Group"; }
addItemToFront_82 = List.AddItemToFront(item=code_block_99, list=watch_7)
code_block_100 = CodeBlock { "Parameter Catagory"; }
join_7 = String.Join(separator=code_block_96, string0=string_from_object_5)

# group (continued): Project Parameters
flatten_43 = List.Flatten(list=join_7)
watch_8 = Watch(flatten_43)

addItemToFront_83 = List.AddItemToFront(item=code_block_100, list=watch_8)
list_create_21 = List.Create(item0=addItemToFront_78, item1=addItemToFront_79, item2=addItemToFront_80, item3=addItemToFront_81, item4=addItemToFront_82, item5=addItemToFront_83)
removeItemAtIndex_15 = List.RemoveItemAtIndex(list=list_create_21, indices=code_block_34, lacing=Longest)
writeOrAppendExcel_v2_15 = Custom[WriteOrAppendExcel_v2](filepath=file_path, sheetName=string_17, baseData=list_create_21, newData=removeItemAtIndex_15)
string_18 = StringInput("Shared Parameters")  # graph input

# group: Shared Parameters
element_types_4 = ElementTypes(index=278)
all_elements_of_type_4 = ElementsOfType(element_type=element_types_4)
name_24 = Family.Name(family=all_elements_of_type_4)
watch_9 = Watch(name_24)

count_20 = List.Count(list=watch_9)
sequence_15 = Sequence(amount=count_20)
addItemToFront_84 = List.AddItemToFront(item=name_for_numbering_column, list=sequence_15)
chop_19 = List.Chop(list=sequence_15, lengths=code_block_31.out0)
replaceItemAtIndex_24 = List.ReplaceItemAtIndex(list=chop_19, index=code_block_31.out1, item=now, lacing=Longest)
flatten_44 = List.Flatten(list=replaceItemAtIndex_24)
addItemToFront_85 = List.AddItemToFront(item=code_block_30, list=flatten_44)
code_block_101 = CodeBlock { "Parameter Names"; }
addItemToFront_86 = List.AddItemToFront(item=code_block_101, list=watch_9)
code_block_102 = CodeBlock { "Shared Parameter Location"; }
sharedParameterFile = Parameter.SharedParameterFile()
watch_10 = Watch(sharedParameterFile)
addItemToFront_87 = List.AddItemToFront(item=code_block_102, list=watch_10)
list_create_22 = List.Create(item0=addItemToFront_84, item1=addItemToFront_85, item2=addItemToFront_86, item3=addItemToFront_87)
removeItemAtIndex_16 = List.RemoveItemAtIndex(list=list_create_22, indices=code_block_34, lacing=Longest)
writeOrAppendExcel_v2_16 = Custom[WriteOrAppendExcel_v2](filepath=file_path, sheetName=string_18, baseData=list_create_22, newData=removeItemAtIndex_16)
string_19 = StringInput("Global Parameters")  # graph input

# group: Global Parameters
element_types_5 = ElementTypes(index=140)
all_elements_of_type_5 = ElementsOfType(element_type=element_types_5)
name_25 = Element.Name(element=all_elements_of_type_5)
watch_11 = Watch(name_25)
value = GlobalParameter.Value(globalParameter=all_elements_of_type_5)
watch_12 = Watch(value)
parameterType = GlobalParameter.ParameterType(globalParameter=all_elements_of_type_5)
watch_13 = Watch(parameterType)
parameterGroup = GlobalParameter.ParameterGroup(globalParameter=all_elements_of_type_5)
watch_14 = Watch(parameterGroup)

count_21 = List.Count(list=watch_11)
sequence_16 = Sequence(amount=count_21)
addItemToFront_88 = List.AddItemToFront(item=name_for_numbering_column, list=sequence_16)
chop_20 = List.Chop(list=sequence_16, lengths=code_block_31.out0)
replaceItemAtIndex_25 = List.ReplaceItemAtIndex(list=chop_20, index=code_block_31.out1, item=now, lacing=Longest)
flatten_45 = List.Flatten(list=replaceItemAtIndex_25)
addItemToFront_89 = List.AddItemToFront(item=code_block_30, list=flatten_45)
code_block_103 = CodeBlock { "Parameter Names"; }
addItemToFront_90 = List.AddItemToFront(item=code_block_103, list=watch_11)
code_block_104 = CodeBlock { "Parameter Value"; }
addItemToFront_91 = List.AddItemToFront(item=code_block_104, list=watch_12)
code_block_105 = CodeBlock { "Parameter Type"; }
addItemToFront_92 = List.AddItemToFront(item=code_block_105, list=watch_13)
code_block_106 = CodeBlock { "Parameter Group"; }
addItemToFront_93 = List.AddItemToFront(item=code_block_106, list=watch_14)
list_create_23 = List.Create(item0=addItemToFront_88, item1=addItemToFront_89, item2=addItemToFront_90, item3=addItemToFront_91, item4=addItemToFront_92, item5=addItemToFront_93)
removeItemAtIndex_17 = List.RemoveItemAtIndex(list=list_create_23, indices=code_block_34, lacing=Longest)
writeOrAppendExcel_v2_17 = Custom[WriteOrAppendExcel_v2](filepath=file_path, sheetName=string_19, baseData=list_create_23, newData=removeItemAtIndex_17)
string_20 = StringInput("Project Phases")  # graph input

# group: Project Phases
element_types_6 = ElementTypes(index=228)
all_elements_of_type_6 = ElementsOfType(element_type=element_types_6)
name_26 = Family.Name(family=all_elements_of_type_6)
watch_15 = Watch(name_26)

count_22 = List.Count(list=watch_15)
sequence_17 = Sequence(amount=count_22)
addItemToFront_94 = List.AddItemToFront(item=name_for_numbering_column, list=sequence_17)
chop_21 = List.Chop(list=sequence_17, lengths=code_block_31.out0)
replaceItemAtIndex_26 = List.ReplaceItemAtIndex(list=chop_21, index=code_block_31.out1, item=now, lacing=Longest)
flatten_46 = List.Flatten(list=replaceItemAtIndex_26)
addItemToFront_95 = List.AddItemToFront(item=code_block_30, list=flatten_46)
code_block_107 = CodeBlock { "Phase Filter"; }
addItemToFront_96 = List.AddItemToFront(item=code_block_107, list=watch_15)
list_create_24 = List.Create(item0=addItemToFront_94, item1=addItemToFront_95, item2=addItemToFront_96)
removeItemAtIndex_18 = List.RemoveItemAtIndex(list=list_create_24, indices=code_block_34, lacing=Longest)
writeOrAppendExcel_v2_18 = Custom[WriteOrAppendExcel_v2](filepath=file_path, sheetName=string_20, baseData=list_create_24, newData=removeItemAtIndex_18)
string_21 = StringInput("Phase Filters")  # graph input

# group: Phase Filters
element_types_7 = ElementTypes(index=229)
all_elements_of_type_7 = ElementsOfType(element_type=element_types_7)
name_27 = Family.Name(family=all_elements_of_type_7)
watch_16 = Watch(name_27)

count_23 = List.Count(list=watch_16)
sequence_18 = Sequence(amount=count_23)
addItemToFront_97 = List.AddItemToFront(item=name_for_numbering_column, list=sequence_18)
chop_22 = List.Chop(list=sequence_18, lengths=code_block_31.out0)
replaceItemAtIndex_27 = List.ReplaceItemAtIndex(list=chop_22, index=code_block_31.out1, item=now, lacing=Longest)
flatten_47 = List.Flatten(list=replaceItemAtIndex_27)
addItemToFront_98 = List.AddItemToFront(item=code_block_30, list=flatten_47)
code_block_108 = CodeBlock { "Phase Filter"; }
addItemToFront_99 = List.AddItemToFront(item=code_block_108, list=watch_16)
list_create_25 = List.Create(item0=addItemToFront_97, item1=addItemToFront_98, item2=addItemToFront_99)
removeItemAtIndex_19 = List.RemoveItemAtIndex(list=list_create_25, indices=code_block_34, lacing=Longest)
writeOrAppendExcel_v2_19 = Custom[WriteOrAppendExcel_v2](filepath=file_path, sheetName=string_21, baseData=list_create_25, newData=removeItemAtIndex_19)
string_22 = StringInput("Links")  # graph input
code_block_109 = CodeBlock { ""; }
replaceNulls_6 = Lists.Manage.ReplaceNulls(Data=getItemAtIndex, ReplaceWith=code_block_109)

# group (continued): Links
file_name = Watch(replaceNulls_6)

count_24 = List.Count(list=file_name)
sequence_19 = Sequence(amount=count_24)
addItemToFront_100 = List.AddItemToFront(item=name_for_numbering_column, list=sequence_19)
chop_23 = List.Chop(list=sequence_19, lengths=code_block_31.out0)
replaceItemAtIndex_28 = List.ReplaceItemAtIndex(list=chop_23, index=code_block_31.out1, item=now, lacing=Longest)
flatten_48 = List.Flatten(list=replaceItemAtIndex_28)
addItemToFront_101 = List.AddItemToFront(item=code_block_30, list=flatten_48)
code_block_110 = CodeBlock { "Link File"; }
addItemToFront_102 = List.AddItemToFront(item=code_block_110, list=file_name)
code_block_111 = CodeBlock { "Link Name"; }
replaceNulls_7 = Lists.Manage.ReplaceNulls(Data=getItemAtIndex_2, ReplaceWith=code_block_109)

# group (continued): Links
link_name = Watch(replaceNulls_7)

addItemToFront_103 = List.AddItemToFront(item=code_block_111, list=link_name)
code_block_112 = CodeBlock { "Location Type"; }
replaceNulls_8 = Lists.Manage.ReplaceNulls(Data=getItemAtIndex_3, ReplaceWith=code_block_109)

# group (continued): Links
location_type = Watch(replaceNulls_8)

addItemToFront_104 = List.AddItemToFront(item=code_block_112, list=location_type)
code_block_113 = CodeBlock { "Link Path"; }
addItemToFront_105 = List.AddItemToFront(item=code_block_113, list=link_path)
code_block_114 = CodeBlock { "Link Angle"; }
addItemToFront_106 = List.AddItemToFront(item=code_block_114, list=projectPosition.Angle_degr)
code_block_115 = CodeBlock { "Link Elevation"; }
addItemToFront_107 = List.AddItemToFront(item=code_block_115, list=projectPosition.Elevation)
code_block_116 = CodeBlock { "Link EastWest"; }
addItemToFront_108 = List.AddItemToFront(item=code_block_116, list=projectPosition.EastWest)
code_block_117 = CodeBlock { "Link NorthSouth"; }
addItemToFront_109 = List.AddItemToFront(item=code_block_117, list=projectPosition.NorthSouth)
code_block_118 = CodeBlock { "Link ID"; }
id_8 = Element.Id(element=all_elements_of_category)

# group (continued): Links
link_id = Watch(id_8)

addItemToFront_110 = List.AddItemToFront(item=code_block_118, list=link_id)
list_create_26 = List.Create(item0=addItemToFront_100, item1=addItemToFront_101, item2=addItemToFront_102, item3=addItemToFront_103, item4=addItemToFront_104, item5=addItemToFront_105, item6=addItemToFront_106, item7=addItemToFront_107, item8=addItemToFront_108, item9=addItemToFront_109, item10=addItemToFront_110)
removeItemAtIndex_20 = List.RemoveItemAtIndex(list=list_create_26, indices=code_block_34, lacing=Longest)
writeOrAppendExcel_v2_20 = Custom[WriteOrAppendExcel_v2](filepath=file_path, sheetName=string_22, baseData=list_create_26, newData=removeItemAtIndex_20)
string_23 = StringInput("Imports")  # graph input

# group: Imports
element_types_8 = ElementTypes(index=160)
all_elements_of_type_8 = ElementsOfType(element_type=element_types_8)
code_block_119 = CodeBlock { "Name"; }
getParameterValueByName_22 = Element.GetParameterValueByName(element=all_elements_of_type_8, parameterName=code_block_119)
import_name = Watch(getParameterValueByName_22)
parameters_3 = Element.Parameters(element=all_elements_of_type_8)
name_28 = Parameter.Name(parameter=parameters_3)
code_block_120 = CodeBlock { "Workset"; }
contains_3 = String.Contains(str=name_28@L2, searchFor=code_block_120)
filterByBoolMask_10 = List.FilterByBoolMask(list=parameters_3, mask=contains_3)
string_from_object_6 = FromObject(obj=filterByBoolMask_10.in)
flatten_49 = List.Flatten(list=string_from_object_6)
code_block_121 = CodeBlock { " : "; }
split_5 = String.Split(str=flatten_49, separater0=code_block_121)
code_block_122 = CodeBlock { 1; }
getItemAtIndex_7 = List.GetItemAtIndex(list=split_5@L2, index=code_block_122)
import_workset_view = Watch(getItemAtIndex_7)
isLinked = Custom[ImportInstance.IsLinked](importInstance=all_elements_of_type_8)  # Determines whether an ImportInstance is linked or not
instance_is_linked = Watch(isLinked)

count_25 = List.Count(list=import_name)
sequence_20 = Sequence(amount=count_25)
addItemToFront_111 = List.AddItemToFront(item=name_for_numbering_column, list=sequence_20)
chop_24 = List.Chop(list=sequence_20, lengths=code_block_31.out0)
replaceItemAtIndex_29 = List.ReplaceItemAtIndex(list=chop_24, index=code_block_31.out1, item=now, lacing=Longest)
flatten_50 = List.Flatten(list=replaceItemAtIndex_29)
addItemToFront_112 = List.AddItemToFront(item=code_block_30, list=flatten_50)
code_block_123 = CodeBlock { "Import Name"; }
addItemToFront_113 = List.AddItemToFront(item=code_block_123, list=import_name)
code_block_124 = CodeBlock { "Import Workset"; }
addItemToFront_114 = List.AddItemToFront(item=code_block_124, list=import_workset_view)
code_block_125 = CodeBlock { "Is Linked"; }
addItemToFront_115 = List.AddItemToFront(item=code_block_125, list=instance_is_linked)
list_create_27 = List.Create(item0=addItemToFront_111, item1=addItemToFront_112, item2=addItemToFront_113, item3=addItemToFront_114, item4=addItemToFront_115)
removeItemAtIndex_21 = List.RemoveItemAtIndex(list=list_create_27, indices=code_block_34, lacing=Longest)
writeOrAppendExcel_v2_21 = Custom[WriteOrAppendExcel_v2](filepath=file_path, sheetName=string_23, baseData=list_create_27, newData=removeItemAtIndex_21)
string_24 = StringInput("Images")  # graph input

# group: images
code_block_126 = CodeBlock { Category.ByName("Raster Images"); }
all_elements_of_category_13 = ElementsOfCategory(Category=code_block_126)
code_block_127 = CodeBlock { "Type"; }
getParameterValueByName_23 = Element.GetParameterValueByName(element=all_elements_of_category_13, parameterName=code_block_127)
name_29 = Element.Name(element=getParameterValueByName_23)
code_block_128 = CodeBlock { "Width (pixels)"; }
getParameterValueByName_24 = Element.GetParameterValueByName(element=getParameterValueByName_23, parameterName=code_block_128)
code_block_129 = CodeBlock { "Height (pixels)"; }
getParameterValueByName_25 = Element.GetParameterValueByName(element=getParameterValueByName_23, parameterName=code_block_129)
mul = getParameterValueByName_24 * getParameterValueByName_25
sortByKey_3 = List.SortByKey(list=name_29, keys=mul)
reverse_4 = List.Reverse(list=sortByKey_3.sorted_list)
all_images = Watch(reverse_4)
reverse_5 = List.Reverse(list=sortByKey_3.sorted_keys)
pixel_count_all_images = Watch(reverse_5)

count_26 = List.Count(list=all_images)
sequence_21 = Sequence(amount=count_26)
addItemToFront_116 = List.AddItemToFront(item=name_for_numbering_column, list=sequence_21)
chop_25 = List.Chop(list=sequence_21, lengths=code_block_31.out0)
replaceItemAtIndex_30 = List.ReplaceItemAtIndex(list=chop_25, index=code_block_31.out1, item=now, lacing=Longest)
flatten_51 = List.Flatten(list=replaceItemAtIndex_30)
addItemToFront_117 = List.AddItemToFront(item=code_block_30, list=flatten_51)
code_block_130 = CodeBlock { "Image Name"; }
addItemToFront_118 = List.AddItemToFront(item=code_block_130, list=all_images)
code_block_131 = CodeBlock { "Pixels"; }
addItemToFront_119 = List.AddItemToFront(item=code_block_131, list=pixel_count_all_images)
list_create_28 = List.Create(item0=addItemToFront_116, item1=addItemToFront_117, item2=addItemToFront_118, item3=addItemToFront_119)
removeItemAtIndex_22 = List.RemoveItemAtIndex(list=list_create_28, indices=code_block_34, lacing=Longest)
writeOrAppendExcel_v2_22 = Custom[WriteOrAppendExcel_v2](filepath=file_path, sheetName=string_24, baseData=list_create_28, newData=removeItemAtIndex_22)
string_25 = StringInput("Workset")  # graph input
count_27 = List.Count(list=workset_name)
sequence_22 = Sequence(amount=count_27)
addItemToFront_120 = List.AddItemToFront(item=name_for_numbering_column, list=sequence_22)
chop_26 = List.Chop(list=sequence_22, lengths=code_block_31.out0)
replaceItemAtIndex_31 = List.ReplaceItemAtIndex(list=chop_26, index=code_block_31.out1, item=now, lacing=Longest)
flatten_52 = List.Flatten(list=replaceItemAtIndex_31)
addItemToFront_121 = List.AddItemToFront(item=code_block_30, list=flatten_52)
code_block_132 = CodeBlock { "Workset Name"; }
addItemToFront_122 = List.AddItemToFront(item=code_block_132, list=workset_name)
list_create_29 = List.Create(item0=addItemToFront_120, item1=addItemToFront_121, item2=addItemToFront_122)
removeItemAtIndex_23 = List.RemoveItemAtIndex(list=list_create_29, indices=code_block_34, lacing=Longest)
writeOrAppendExcel_v2_23 = Custom[WriteOrAppendExcel_v2](filepath=file_path, sheetName=string_25, baseData=list_create_29, newData=removeItemAtIndex_23)
string_26 = StringInput("Inplace Families")  # graph input

# group: Families
element_types_9 = ElementTypes(index=119)
all_elements_of_type_9 = ElementsOfType(element_type=element_types_9)
isInPlace = Custom[Family.IsInPlace](family=all_elements_of_type_9)  # Determines if a family is an in-place family
filterByBoolMask_11 = List.FilterByBoolMask(list=all_elements_of_type_9, mask=isInPlace)
types = Family.Types(family=filterByBoolMask_11.in)
code_block_133 = CodeBlock { null; }
replaceEmptyLists = Custom[List.ReplaceEmptyLists](seq=types@L2, Replacement=code_block_133)  # Replaces all empty lists within a given list with a substitute
flatten_53 = List.Flatten(list=replaceEmptyLists)
code_block_134 = CodeBlock { " "; }
replaceNulls_9 = Lists.Manage.ReplaceNulls(Data=flatten_53, ReplaceWith=code_block_134)
string_from_object_7 = FromObject(obj=replaceNulls_9)
inplace_family_type = Watch(string_from_object_7)
list_create_30 = List.Create()  # unwired: item0
map_5 = List.Map(list=filterByBoolMask_11.in, f_x=list_create_30)
count_28 = List.Count(list=types@L2)
code_block_135 = CodeBlock { 1; }
max = Math.Max(value1=count_28, value2=code_block_135)
ofRepeatedItem = List.OfRepeatedItem(item=code_block_133, amount=max)
restOfItems = List.RestOfItems(list=ofRepeatedItem@L2)
addItemToFront_123 = List.AddItemToFront(item=map_5@L2, list=restOfItems@L2)
flatten_54 = List.Flatten(list=addItemToFront_123)
replaceNulls_10 = Lists.Manage.ReplaceNulls(Data=flatten_54, ReplaceWith=code_block_134)
types_2 = Family.Types(family=filterByBoolMask_11.out)
code_block_136 = CodeBlock { null; }
replaceEmptyLists_2 = Custom[List.ReplaceEmptyLists](seq=types_2@L2, Replacement=code_block_136)
flatten_55 = List.Flatten(list=replaceEmptyLists_2)
code_block_137 = CodeBlock { " "; }
replaceNulls_11 = Lists.Manage.ReplaceNulls(Data=flatten_55, ReplaceWith=code_block_137)
string_from_object_8 = FromObject(obj=replaceNulls_11)
other_family_type = Watch(string_from_object_8)
list_create_31 = List.Create()  # unwired: item0
map_6 = List.Map(list=filterByBoolMask_11.out, f_x=list_create_31)
count_29 = List.Count(list=types_2@L2)
code_block_138 = CodeBlock { 1; }
max_2 = Math.Max(value1=count_29, value2=code_block_138)
ofRepeatedItem_2 = List.OfRepeatedItem(item=code_block_136, amount=max_2)
restOfItems_2 = List.RestOfItems(list=ofRepeatedItem_2@L2)
addItemToFront_124 = List.AddItemToFront(item=map_6@L2, list=restOfItems_2@L2)
flatten_56 = List.Flatten(list=addItemToFront_124)
replaceNulls_12 = Lists.Manage.ReplaceNulls(Data=flatten_56, ReplaceWith=code_block_137)
string_from_object_9 = FromObject(obj=replaceNulls_12)
other_family = Watch(string_from_object_9)

count_30 = List.Count(list=inplace_family_type)
sequence_23 = Sequence(amount=count_30)
addItemToFront_125 = List.AddItemToFront(item=name_for_numbering_column, list=sequence_23)
chop_27 = List.Chop(list=sequence_23, lengths=code_block_31.out0)
replaceItemAtIndex_32 = List.ReplaceItemAtIndex(list=chop_27, index=code_block_31.out1, item=now, lacing=Longest)
flatten_57 = List.Flatten(list=replaceItemAtIndex_32)
addItemToFront_126 = List.AddItemToFront(item=code_block_30, list=flatten_57)
code_block_139 = CodeBlock { "InPlace Family Name"; }
name_30 = Element.Name(element=replaceNulls_10)

# group (continued): Families
string_from_object_10 = FromObject(obj=name_30)
inplace_family = Watch(string_from_object_10)

addItemToFront_127 = List.AddItemToFront(item=code_block_139, list=inplace_family)
code_block_140 = CodeBlock { "InPlace Family Type"; }
addItemToFront_128 = List.AddItemToFront(item=code_block_140, list=inplace_family_type)
list_create_32 = List.Create(item0=addItemToFront_125, item1=addItemToFront_126, item2=addItemToFront_127, item3=addItemToFront_128)
removeItemAtIndex_24 = List.RemoveItemAtIndex(list=list_create_32, indices=code_block_34, lacing=Longest)
writeOrAppendExcel_v2_24 = Custom[WriteOrAppendExcel_v2](filepath=file_path, sheetName=string_26, baseData=list_create_32, newData=removeItemAtIndex_24)
string_27 = StringInput("Families")  # graph input
count_31 = List.Count(list=other_family_type)
sequence_24 = Sequence(amount=count_31)
addItemToFront_129 = List.AddItemToFront(item=name_for_numbering_column, list=sequence_24)
chop_28 = List.Chop(list=sequence_24, lengths=code_block_31.out0)
replaceItemAtIndex_33 = List.ReplaceItemAtIndex(list=chop_28, index=code_block_31.out1, item=now, lacing=Longest)
flatten_58 = List.Flatten(list=replaceItemAtIndex_33)
addItemToFront_130 = List.AddItemToFront(item=code_block_30, list=flatten_58)
code_block_141 = CodeBlock { "Family Name"; }
addItemToFront_131 = List.AddItemToFront(item=code_block_141, list=other_family)
code_block_142 = CodeBlock { "Family Type"; }
addItemToFront_132 = List.AddItemToFront(item=code_block_142, list=other_family_type)
list_create_33 = List.Create(item0=addItemToFront_129, item1=addItemToFront_130, item2=addItemToFront_131, item3=addItemToFront_132)
removeItemAtIndex_25 = List.RemoveItemAtIndex(list=list_create_33, indices=code_block_34, lacing=Longest)
writeOrAppendExcel_v2_25 = Custom[WriteOrAppendExcel_v2](filepath=file_path, sheetName=string_27, baseData=list_create_33, newData=removeItemAtIndex_25)
string_28 = StringInput("Furniture")  # graph input
count_32 = List.Count(list=name_4)
sequence_25 = Sequence(amount=count_32)
addItemToFront_133 = List.AddItemToFront(item=name_for_numbering_column, list=sequence_25)
chop_29 = List.Chop(list=sequence_25, lengths=code_block_31.out0)
replaceItemAtIndex_34 = List.ReplaceItemAtIndex(list=chop_29, index=code_block_31.out1, item=now, lacing=Longest)
flatten_59 = List.Flatten(list=replaceItemAtIndex_34)
addItemToFront_134 = List.AddItemToFront(item=code_block_30, list=flatten_59)
code_block_143 = CodeBlock { "Furniture Name"; }
addItemToFront_135 = List.AddItemToFront(item=code_block_143, list=name_4)
list_create_34 = List.Create(item0=addItemToFront_133, item1=addItemToFront_134, item2=addItemToFront_135)
removeItemAtIndex_26 = List.RemoveItemAtIndex(list=list_create_34, indices=code_block_34, lacing=Longest)
writeOrAppendExcel_v2_26 = Custom[WriteOrAppendExcel_v2](filepath=file_path, sheetName=string_28, baseData=list_create_34, newData=removeItemAtIndex_26)
string_29 = StringInput("Views")  # graph input
join_8 = List.Join()  # unwired: list0, list1
combine = List.Combine(comb=join_8, list1=list_create_6, list2=removeItemAtIndex_3)
removeItemAtIndex_27 = List.RemoveItemAtIndex(list=combine, indices=code_block_34, lacing=Longest)
writeOrAppendExcel_v2_27 = Custom[WriteOrAppendExcel_v2](filepath=file_path, sheetName=string_29, baseData=combine, newData=removeItemAtIndex_27)
string_30 = StringInput("Project Basepoint")  # graph input

# group: Project Basepoint
categories_13 = Categories(index=451)
all_elements_of_category_14 = ElementsOfCategory(Category=categories_13)
string_31 = StringInput("N/S")
getParameterValueByName_26 = Element.GetParameterValueByName(element=all_elements_of_category_14, parameterName=string_31)
count_33 = List.Count(list=getParameterValueByName_26)
sequence_26 = Sequence(amount=count_33)
chop_30 = List.Chop(list=sequence_26, lengths=code_block_31.out0)
replaceItemAtIndex_35 = List.ReplaceItemAtIndex(list=chop_30, index=code_block_31.out1, item=now, lacing=Longest)
flatten_60 = List.Flatten(list=replaceItemAtIndex_35)
string_32 = StringInput("E/W")
getParameterValueByName_27 = Element.GetParameterValueByName(element=all_elements_of_category_14, parameterName=string_32)
string_33 = StringInput("Elev")
getParameterValueByName_28 = Element.GetParameterValueByName(element=all_elements_of_category_14, parameterName=string_33)
string_34 = StringInput("Angle to True North")
getParameterValueByName_29 = Element.GetParameterValueByName(element=all_elements_of_category_14, parameterName=string_34)

addItemToFront_136 = List.AddItemToFront(item=name_for_numbering_column, list=sequence_26)
addItemToFront_137 = List.AddItemToFront(item=code_block_30, list=flatten_60)
string_35 = StringInput("E/W")
addItemToFront_138 = List.AddItemToFront(item=string_35, list=getParameterValueByName_27)
string_36 = StringInput("N/S")
addItemToFront_139 = List.AddItemToFront(item=string_36, list=getParameterValueByName_26)
string_37 = StringInput("Elevation")
addItemToFront_140 = List.AddItemToFront(item=string_37, list=getParameterValueByName_28)
string_38 = StringInput("Angle to True North")
addItemToFront_141 = List.AddItemToFront(item=string_38, list=getParameterValueByName_29)
list_create_35 = List.Create(item0=addItemToFront_136, item1=addItemToFront_137, item2=addItemToFront_138, item3=addItemToFront_139, item4=addItemToFront_140, item5=addItemToFront_141)
removeItemAtIndex_28 = List.RemoveItemAtIndex(list=list_create_35, indices=code_block_34, lacing=Longest)
writeOrAppendExcel_v2_28 = Custom[WriteOrAppendExcel_v2](filepath=file_path, sheetName=string_30, baseData=list_create_35, newData=removeItemAtIndex_28)
string_39 = StringInput("Survey Point")  # graph input

# group: Survey Point
categories_14 = Categories(index=454)
all_elements_of_category_15 = ElementsOfCategory(Category=categories_14)
string_40 = StringInput("N/S")
getParameterValueByName_30 = Element.GetParameterValueByName(element=all_elements_of_category_15, parameterName=string_40)
count_34 = List.Count(list=getParameterValueByName_30)
sequence_27 = Sequence(amount=count_34)
chop_31 = List.Chop(list=sequence_27, lengths=code_block_31.out0)
replaceItemAtIndex_36 = List.ReplaceItemAtIndex(list=chop_31, index=code_block_31.out1, item=now, lacing=Longest)
flatten_61 = List.Flatten(list=replaceItemAtIndex_36)
string_41 = StringInput("E/W")
getParameterValueByName_31 = Element.GetParameterValueByName(element=all_elements_of_category_15, parameterName=string_41)
string_42 = StringInput("Elev")
getParameterValueByName_32 = Element.GetParameterValueByName(element=all_elements_of_category_15, parameterName=string_42)

addItemToFront_142 = List.AddItemToFront(item=name_for_numbering_column, list=sequence_27)
addItemToFront_143 = List.AddItemToFront(item=code_block_30, list=flatten_61)
string_43 = StringInput("E/W")
addItemToFront_144 = List.AddItemToFront(item=string_43, list=getParameterValueByName_31)
string_44 = StringInput("N/S")
addItemToFront_145 = List.AddItemToFront(item=string_44, list=getParameterValueByName_30)
string_45 = StringInput("Elevation")
addItemToFront_146 = List.AddItemToFront(item=string_45, list=getParameterValueByName_32)
list_create_36 = List.Create(item0=addItemToFront_142, item1=addItemToFront_143, item2=addItemToFront_144, item3=addItemToFront_145, item4=addItemToFront_146)
removeItemAtIndex_29 = List.RemoveItemAtIndex(list=list_create_36, indices=code_block_34, lacing=Longest)
writeOrAppendExcel_v2_29 = Custom[WriteOrAppendExcel_v2](filepath=file_path, sheetName=string_39, baseData=list_create_36, newData=removeItemAtIndex_29)
string_46 = StringInput("Levels")  # graph input

# group: Levels
categories_15 = Categories(index=248)
all_elements_of_category_16 = ElementsOfCategory(Category=categories_15)
name_31 = Level.Name(level=all_elements_of_category_16)
count_35 = List.Count(list=name_31)
sequence_28 = Sequence(amount=count_35)
chop_32 = List.Chop(list=sequence_28, lengths=code_block_31.out0)
replaceItemAtIndex_37 = List.ReplaceItemAtIndex(list=chop_32, index=code_block_31.out1, item=now, lacing=Longest)
flatten_62 = List.Flatten(list=replaceItemAtIndex_37)
elevation = Level.Elevation(level=all_elements_of_category_16)

addItemToFront_147 = List.AddItemToFront(item=name_for_numbering_column, list=sequence_28)
addItemToFront_148 = List.AddItemToFront(item=code_block_30, list=flatten_62)
string_47 = StringInput("Level Name")
addItemToFront_149 = List.AddItemToFront(item=string_47, list=name_31)
string_48 = StringInput("Level Elevation")
addItemToFront_150 = List.AddItemToFront(item=string_48, list=elevation)
list_create_37 = List.Create(item0=addItemToFront_147, item1=addItemToFront_148, item2=addItemToFront_149, item3=addItemToFront_150)
removeItemAtIndex_30 = List.RemoveItemAtIndex(list=list_create_37, indices=code_block_34, lacing=Longest)
writeOrAppendExcel_v2_30 = Custom[WriteOrAppendExcel_v2](filepath=file_path, sheetName=string_46, baseData=list_create_37, newData=removeItemAtIndex_30)
string_49 = StringInput("Grids")  # graph input

# group: Grids
categories_16 = Categories(index=233)
all_elements_of_category_17 = ElementsOfCategory(Category=categories_16)
name_32 = Level.Name(level=all_elements_of_category_17)

name_33 = Element.Name(element=all_elements_of_category_17)

# group (continued): Grids
count_36 = List.Count(list=name_33)
sequence_29 = Sequence(amount=count_36)
chop_33 = List.Chop(list=sequence_29, lengths=code_block_31.out0)
replaceItemAtIndex_38 = List.ReplaceItemAtIndex(list=chop_33, index=code_block_31.out1, item=now, lacing=Longest)
flatten_63 = List.Flatten(list=replaceItemAtIndex_38)

addItemToFront_151 = List.AddItemToFront(item=name_for_numbering_column, list=sequence_29)
addItemToFront_152 = List.AddItemToFront(item=code_block_30, list=flatten_63)
string_50 = StringInput("Grid Name")
addItemToFront_153 = List.AddItemToFront(item=string_50, list=name_33)
list_create_38 = List.Create(item0=addItemToFront_151, item1=addItemToFront_152, item2=addItemToFront_153)
removeItemAtIndex_31 = List.RemoveItemAtIndex(list=list_create_38, indices=code_block_34, lacing=Longest)
writeOrAppendExcel_v2_31 = Custom[WriteOrAppendExcel_v2](filepath=file_path, sheetName=string_49, baseData=list_create_38, newData=removeItemAtIndex_31)
string_51 = StringInput("Project Info")  # graph input
string_52 = StringInput("A1")  # graph input

# group: Project Info
python_script_7 = Python()
# ---------- python_script_7.python (30 lines) ----------
# Enable Python support and load DesignScript library
import clr

clr.AddReference("RevitNodes")
import Revit
clr.ImportExtensions(Revit.Elements)

clr.AddReference("RevitServices")
import RevitServices
from RevitServices.Persistence import DocumentManager
doc = DocumentManager.Instance.CurrentDBDocument

clr.AddReference("RevitAPI")
import Autodesk
from Autodesk.Revit.DB import *

doc = DocumentManager.Instance.CurrentDBDocument

# The inputs to this node will be stored as a list in the IN variables.
dataEnteringNode = IN

# Place your code below this line
projectInfo = doc.ProjectInformation
ProjectName = projectInfo.Name
ProjectNumber = projectInfo.Number
projectFile = doc.Title + ".rvt"
projectPath = doc.PathName

# Assign your output to the OUT variable.
OUT = [ProjectName, ProjectNumber, projectFile, projectPath]
# ----------------------------------------
code_block_144 = CodeBlock { 0; 1; 2; 3; }
getItemAtIndex_8 = List.GetItemAtIndex(list=python_script_7, index=code_block_144.out0)
count_37 = List.Count(list=getItemAtIndex_8)
sequence_30 = Sequence(amount=count_37)
getItemAtIndex_9 = List.GetItemAtIndex(list=python_script_7, index=code_block_144.out1)
getItemAtIndex_10 = List.GetItemAtIndex(list=python_script_7, index=code_block_144.out2)

addItemToFront_154 = List.AddItemToFront(item=name_for_numbering_column, list=sequence_30)
string_53 = StringInput("Project Name")
addItemToFront_155 = List.AddItemToFront(item=string_53, list=getItemAtIndex_8)
string_54 = StringInput("Project Number")
addItemToFront_156 = List.AddItemToFront(item=string_54, list=getItemAtIndex_9)
string_55 = StringInput("Project Filename")
addItemToFront_157 = List.AddItemToFront(item=string_55, list=getItemAtIndex_10)
list_create_39 = List.Create(item0=addItemToFront_154, item1=addItemToFront_155, item2=addItemToFront_156, item3=addItemToFront_157)
bb_data = Custom[BB Data](sheetName=string_51, origin=string_52, data=list_create_39)  # This node is a building block for different modes of writing to Excel files. You can combines this node into a list to write to multiple sheets or use just one to write to a single sheet.
string_56 = StringInput("File Size")  # graph input

# group: File Size
getItemAtIndex_11 = List.GetItemAtIndex(list=python_script_7, index=code_block_144.out3)
ꟿ_filepath_size = Custom[ꟿ FilePath.Size](path=getItemAtIndex_11)  # Outputs the the file size in kilobytes or megabytes. Provide a file path as a string. Set kbOnly to true for a consistent output.
count_38 = List.Count(list=ꟿ_filepath_size)
sequence_31 = Sequence(amount=count_38)
chop_34 = List.Chop(list=sequence_31, lengths=code_block_31.out0)
replaceItemAtIndex_39 = List.ReplaceItemAtIndex(list=chop_34, index=code_block_31.out1, item=now, lacing=Longest)
flatten_64 = List.Flatten(list=replaceItemAtIndex_39)

addItemToFront_158 = List.AddItemToFront(item=name_for_numbering_column, list=sequence_31)
addItemToFront_159 = List.AddItemToFront(item=code_block_30, list=flatten_64)
code_block_145 = CodeBlock { "File Size"; }
addItemToFront_160 = List.AddItemToFront(item=code_block_145, list=ꟿ_filepath_size)
list_create_40 = List.Create(item0=addItemToFront_158, item1=addItemToFront_159, item2=addItemToFront_160)
removeItemAtIndex_32 = List.RemoveItemAtIndex(list=list_create_40, indices=code_block_34, lacing=Longest)
writeOrAppendExcel_v2_32 = Custom[WriteOrAppendExcel_v2](filepath=file_path, sheetName=string_56, baseData=list_create_40, newData=removeItemAtIndex_32)
list_create_41 = List.Create(item0=writeOrAppendExcel_v2, item1=writeOrAppendExcel_v2_2, item2=writeOrAppendExcel_v2_3, item3=writeOrAppendExcel_v2_4, item4=writeOrAppendExcel_v2_5, item5=writeOrAppendExcel_v2_6, item6=writeOrAppendExcel_v2_7, item7=writeOrAppendExcel_v2_8, item8=writeOrAppendExcel_v2_9, item9=writeOrAppendExcel_v2_10, item10=writeOrAppendExcel_v2_11, item11=writeOrAppendExcel_v2_12, item12=writeOrAppendExcel_v2_13, item13=writeOrAppendExcel_v2_14, item14=writeOrAppendExcel_v2_15, item15=writeOrAppendExcel_v2_16, item16=writeOrAppendExcel_v2_17, item17=writeOrAppendExcel_v2_18, item18=writeOrAppendExcel_v2_19, item19=writeOrAppendExcel_v2_20, item20=writeOrAppendExcel_v2_21, item21=writeOrAppendExcel_v2_22, item22=writeOrAppendExcel_v2_23, item23=writeOrAppendExcel_v2_24, item24=writeOrAppendExcel_v2_25, item25=writeOrAppendExcel_v2_26, item26=writeOrAppendExcel_v2_27, item27=writeOrAppendExcel_v2_28, item28=writeOrAppendExcel_v2_29, item29=writeOrAppendExcel_v2_30, item30=writeOrAppendExcel_v2_31, item31=bb_data, item32=writeOrAppendExcel_v2_32)
write_excel = Custom[Write Excel](filePath=file_path, runIt=boolean_2, byColumn=boolean_3, BBData=list_create_41)  # This node will write data to Excel file and based on how your BBData nodes are structured it will either override the exsting file, create a new one and write a single worksheet or write multiple worksheets.
